# Grasshopper definition Reinforced Concrete Form Active.gh (Grasshopper 1.0.8)
# plug-ins: Tunny, Karamba3D, Kangaroo2 Components

number_slider = Slider(30, range=1..100)
# Mesh
srf = Surface(<surface referenced from the Rhino model>)
mesh_uv = MeshSurface(Surface=srf, UCount=number_slider, VCount=Slider(4, range=1..30), Overhang=True, Equalize=False)

number_slider_2 = Slider(0.018, range=0.001..0.05)
number_slider_3 = Slider(7000, range=1..7000)
custom_mesh_settings = SettingsCustom(
    StitchSeams=True,
    SimplePlanes=False,
    Refine=True,
    MinCount=number_slider_3,
    MaxCount=number_slider_3,
    AspectRatio=20,
    MaxDistance=0,
    MaxAngle=20,
    MinEdge=number_slider_3,
    MaxEdge=number_slider_3)
minimise_cost = Number()

# ----
# Kangaroo
nv = NakedVertices(Mesh=mesh_uv)  # -> ClothedIndex, NakedIndex, ClothedPts, NakedPts
crv = Curve([<curve referenced from the Rhino model> x2])
incurves = PointInCurves(Point=nv.NakedPts, Curves=crv)  # -> Relationship, Index, Point
dispatch = Dispatch(List=nv.NakedPts, DispatchPattern=incurves.Relationship)  # -> ListA, ListB
pt = Point(nv.ClothedPts)
pt_2 = Point(dispatch.ListB)
merge = Merge(Data1=pt, Data2=pt_2)
pt_3 = Point(dispatch.ListA)
Z = UnitZ(Factor=1)
edgelengths = EdgeLengths(Mesh=mesh_uv, LengthFactor=1, Strength=Slider(1, range=0..100))
show = Show(G=mesh_uv)
anchor = Anchor(Point=pt_3, Strength=Slider(100, range=1..100))
load = Load(Point=merge, ForceVector=Z, Weighting=number_slider_2)
merge_2 = Merge(Data1=show, Data2=load, Data3=anchor, Data4=edgelengths)

zombiesolver = ZombieSolver(GoalObjects=merge_2, Threshold=1e-10, Tolerance=0.0001, MaxIterations=50000)  # -> I, V, O

panel = Panel(zombiesolver.V)

# ----
# Sorting Coordinates
pt_4 = Point(panel)
pdecon = Deconstruct(Point=pt_4)  # -> XComponent, YComponent, ZComponent
sort = SortList(Keys=pdecon.YComponent, ValuesA=pt_4)  # -> Keys, ValuesA
partition = PartitionList(List=sort.ValuesA, Size=expr("x+1", number_slider))
pdecon_2 = Deconstruct(Point=partition)  # -> XComponent, YComponent, ZComponent
sort_2 = SortList(Keys=pdecon_2.XComponent, ValuesA=partition)  # -> Keys, ValuesA
intcrv = Interpolate(Vertices=sort_2.ValuesA, Degree=3, Periodic=False, KnotStyle=1)  # -> flatten(Curve), Length, Domain

loft = Loft(Curves=intcrv.Curve, Options={Adjust=False, Closed=False, LoftEnds=0, LoftSimp=0, LoftType=0, Rebuild=10, Refit=0.01})
mesh = MeshBrep(Brep=loft, Settings=custom_mesh_settings)

# ----
# Supports
nv_2 = NakedVertices(Mesh=mesh)  # -> ClothedIndex, NakedIndex, ClothedPts, NakedPts
# Loads
crv_2 = Curve([<curve referenced from the Rhino model> x2])
incurves_2 = PointInCurves(Point=nv_2.NakedPts, Curves=crv_2)  # -> Relationship, Index, Point
dispatch_2 = Dispatch(List=nv_2.NakedPts, DispatchPattern=incurves_2.Relationship)  # -> ListA, ListB
pt_5 = Point(dispatch_2.ListA)
supp = SupportKaramba3D(PosInd=pt_5, menu=[buttons(on, on, on, on, on, on)])  # -> flatten(Support)

number_slider_4 = Slider(42, range=10..100)
# Mesh to Shell (material and cross section)
matselect = MaterialSelectionKaramba3D(menu=[dropdown(7), dropdown(7)])
cross_section = CrossSectionKaramba3D(
    FamilyNameOfCrossSection="DefaultCroSec",
    MaterialConcrete=matselect,
    Height_cm=number_slider_4,
    ReinforcementAreas_cm2_m=[0, 0, 0, 0],
    ReinforcementConcreteCovers_cm=[3.5, 4.5, -4.5, -3.5],
    PrincipalReinforcementDirection_deg=0,
    mode="Shell RC Standard - Const.")
meshtoshell = MeshToShellKaramba3D(Mesh=mesh, CrossSection=cross_section, LimitDistance_m=0.005)  # -> Element, Points, Info

# ----
# Calculate Volume
explode = Explode(Curve=srf, Recursive=True)  # -> Segments, Vertices
item = ListItem(List=explode.Segments, Index=0, Wrap=True)  # -> Item, Item1, Item2, Item3
slab_depth = Curve(item.Item2)
slab_span = Curve(intcrv.Curve)
slab_height = Number(number_slider_4)
len = Length(Curve=slab_depth)
len_2 = Length(Curve=slab_span)
expression = Expression(x=len_2, y=len, z=slab_height, Expression="x*y*(z/100)")
volume_m_3 = Panel(expression)

item_2 = ListItem(List=volume_m_3, Index=0, Wrap=True)

# ----
# Calculate Weight
density_kg_m_3 = Panel("2500")
expression_2 = Expression(x=density_kg_m_3, y=item_2, Expression="x*y")
weight_kg = Panel(expression_2)

# ----
# Calculate Embodied Carbon
embodied_carbon_per_kg_kgco2e_kg = Panel("1.55")
expression_3 = Expression(x=embodied_carbon_per_kg_kgco2e_kg, y=weight_kg, Expression="x*y")
total_embodied_carbon_kgco2 = Panel(expression_3)

# ----
# Calculate Cost
lng = ListLength(List=pt_4)
expression_4 = Expression(x=lng, Expression="x/2")
explode_2 = Explode(Curve=srf, Recursive=True)  # -> Segments, Vertices
item_3 = ListItem(List=pt_4, Index=expression_4, Wrap=True)
item_4 = ListItem(List=explode_2.Segments, Index=0, Wrap=True)  # -> Item, Item1, Item2, Item3
pdecon_3 = Deconstruct(Point=item_3)  # -> XComponent, YComponent, ZComponent
span = Curve(item_4.Item3)
len_3 = Length(Curve=span)
height = Number(pdecon_3.ZComponent)
complexity_factor = Panel("1.5")
price_per_kg_kg = Panel("1.06")
expression_5 = Expression(x=complexity_factor, y="2", z=height, u=len_3, v=weight_kg, w=price_per_kg_kg, Expression="x*y*z*u*v*w")
price = Panel(expression_5)

minimise_embodied_carbon = Number(total_embodied_carbon_kgco2)

loads = LoadsKaramba3D(Vector=Vector(0, 0, -1), LCase="0", mode="Gravity")

expression_6 = Expression(x="1.75", Expression="1.5*x")

Z_2 = UnitZ(Factor=expression_6)  # -> expr("-x", UnitVector)
loads_2 = LoadsKaramba3D(Vectors=Z_2, Mesh=mesh, LCase="0", mode="MeshLoad -Variable", menu=[buttons(off, on, off), buttons(on, off)])

assemble = AssembleModelKaramba3D(Elem=meshtoshell.Element, Support=supp, Load=[loads_2, loads], LimitDistance_m=0.005)  # -> Model, Info, Mass_kg, CenterOfGravity, LoadCaseNames
analyze = AnalyzeKaramba3D(Model=assemble.Model)  # -> CalculatedModel, MaximumDisplacement_cm, ResultingForceOfGravity_kN, ElasticEnergyChange_kNm
# Analysis and Results
panel_2 = Panel(assemble.Model)
modelview = ModelViewKaramba3D(Model=analyze.CalculatedModel, ResultFactors=1, ResultCase=-1)  # -> Model, DeformedMesh, DeformedAxes, DeformedModel
panel_3 = Panel(analyze.MaximumDisplacement_cm)
shellview = ShellViewKaramba3D(Model=modelview.Model, IndexOfLayer=0)  # -> Model, MeshesOfRenderedShells, LegendColors, LegendTags
shellview_2 = ShellViewKaramba3D(Model=modelview.Model, IndexOfLayer=0)  # -> Model, MeshesOfRenderedShells, LegendColors, LegendTags

# ----
# Displacement Constraints
expression_7 = Expression(x=panel_3, Expression="x/100")
expression_8 = Expression(x=len_2, Expression="x/250")
item_5 = ListItem(List=expression_8, Index=0, Wrap=True)
actual_displacement_m = Panel(expression_7)
max_allowable_displacement = Panel(item_5)
expression_9 = Expression(x=actual_displacement_m, y=max_allowable_displacement, Expression="x-y")

panel_4 = Panel(shellview_2.LegendTags)
# Stress Constraint
panel_5 = Panel(shellview.LegendTags)
subset = SubList(List=panel_4, Domain="1 to 11", Wrap=True)  # -> flatten(List), Index
subset_2 = SubList(List=panel_5, Domain="1 to 11", Wrap=True)  # -> flatten(List), Index
panel_6 = Panel(subset.List)
panel_7 = Panel(subset_2.List)
bnd = Bounds(Numbers=expr("Abs(x)", panel_6))
bnd_2 = Bounds(Numbers=expr("Abs(x)", panel_7))
dedomain = DeconstructDomain(Domain=bnd)  # -> Start, End
dedomain_2 = DeconstructDomain(Domain=bnd_2)  # -> Start, End
panel_8 = Panel(dedomain.End)
panel_9 = Panel(dedomain_2.End)
max = Maximum(A=panel_9, B=panel_8)
max_actual_stress_kn_cm_2 = Panel(max)
item_6 = ListItem(List=max_actual_stress_kn_cm_2, Index=0, Wrap=True)  # -> Item, Item1
expression_10 = Expression(x=item_6.Item1, Expression="Abs(x*10)")
max_actual_stress_mpa = Panel(expression_10)
max_allowable_stress_mpa = Panel("35")
expression_11 = Expression(x=max_actual_stress_mpa, y=max_allowable_stress_mpa, Expression="x-y")

constrfa = ConstructFishAttribute(Constraint=expression_9)
tunny = Tunny(Variables=[number_slider_4, number_slider_2], Objectives=[minimise_embodied_carbon, minimise_cost], Attributes=constrfa)
