# Grasshopper definition Reinforced Concrete Non-Form Active.gh (Grasshopper 1.0.8)
# plug-ins: Tunny, Karamba3D, Kangaroo2 Components

# ----
# Mesh
mon = Surface(<surface referenced from the Rhino model>)
mplane = MeshPlane(Boundary=mon, WidthCount=Slider(25, range=0..50), HeightCount=Slider(10, range=0..30))  # -> Mesh, Area

# ----
# Supports
nv = NakedVertices(Mesh=mplane.Mesh)  # -> ClothedIndex, NakedIndex, ClothedPts, NakedPts
# Loads
crv = Curve([<curve referenced from the Rhino model> x2])
incurves = PointInCurves(Point=nv.NakedPts, Curves=crv)  # -> Relationship, Index, Point
dispatch = Dispatch(List=nv.NakedPts, DispatchPattern=incurves.Relationship)  # -> ListA, ListB
pt = Point(dispatch.ListA)
supp = SupportKaramba3D(PosInd=pt, menu=[buttons(on, on, on, on, on, on)])  # -> flatten(Support)

number_slider = Slider(10, range=10..100)
# Mesh to Shell (material and cross section)
matselect = MaterialSelectionKaramba3D(menu=[dropdown(7), dropdown(7)])
cross_section = CrossSectionKaramba3D(
    FamilyNameOfCrossSection="DefaultCroSec",
    MaterialConcrete=matselect,
    Height_cm=number_slider,
    ReinforcementAreas_cm2_m=[0, 0, 0, 0],
    ReinforcementConcreteCovers_cm=[3.5, 4.5, -4.5, -3.5],
    PrincipalReinforcementDirection_deg=0,
    mode="Shell RC Standard - Const.")
meshtoshell = MeshToShellKaramba3D(Mesh=mplane.Mesh, CrossSection=cross_section, LimitDistance_m=0.005)  # -> Element, Points, Info

explode = Explode(Curve=mon, Recursive=True)  # -> Segments, Vertices
item = ListItem(List=explode.Segments, Index=0, Wrap=True)  # -> Item, Item1, Item2, Item3
slab_depth = Curve(item.Item2)
slab_span = Curve(item.Item1)
slab_height = Number(number_slider)
len = Length(Curve=slab_depth)
len_2 = Length(Curve=slab_span)
expression = Expression(x=len_2, y=len, z=slab_height, Expression="x*y*(z/100)")
volume_m_3 = Panel(expression)

density_kg_m_3 = Panel("2500")
expression_2 = Expression(x=density_kg_m_3, y=volume_m_3, Expression="x*y")
weight_kg = Panel(expression_2)

# ----
# Calculate Embodied Carbon
# Calculate Cost
embodied_carbon_per_kg_kgco2e_kg = Panel("1.55")
expression_3 = Expression(x=embodied_carbon_per_kg_kgco2e_kg, y=weight_kg, Expression="x*y")
total_embodied_carbon_kgco2 = Panel(expression_3)

explode_2 = Explode(Curve=mon, Recursive=True)  # -> Segments, Vertices
item_2 = ListItem(List=explode_2.Segments, Index=0, Wrap=True)  # -> Item, Item1, Item2, Item3
span = Curve(item_2.Item3)
expression_4 = Expression(x=number_slider, Expression="x/100")
len_3 = Length(Curve=span)
height = Number(expression_4)
complexity_factor = Panel("1")
price_per_kg_kg = Panel("1.06")
expression_5 = Expression(x=complexity_factor, y="2", z=height, u=len_3, v=weight_kg, w=price_per_kg_kg, Expression="x*y*z*u*v*w")
price = Panel(expression_5)

minimise_embodied_carbon = Number(total_embodied_carbon_kgco2)
minimise_cost = Number(price)

loads = LoadsKaramba3D(Vector=Vector(0, 0, -1), LCase="0", mode="Gravity")

expression_6 = Expression(x="1.75", Expression="1.5*x")

Z = UnitZ(Factor=expression_6)  # -> expr("-x", UnitVector)
loads_2 = LoadsKaramba3D(Vectors=Z, Mesh=mplane.Mesh, LCase="0", mode="MeshLoad -Variable", menu=[buttons(off, on, off), buttons(on, off)])
panel = Panel(loads_2)

assemble = AssembleModelKaramba3D(Elem=meshtoshell.Element, Support=supp, Load=[loads_2, loads], LimitDistance_m=0.005)  # -> Model, Info, Mass_kg, CenterOfGravity, LoadCaseNames
analyze = AnalyzeKaramba3D(Model=assemble.Model)  # -> CalculatedModel, MaximumDisplacement_cm, ResultingForceOfGravity_kN, ElasticEnergyChange_kNm
# Analysis and Results
panel_2 = Panel(assemble.Model)
modelview = ModelViewKaramba3D(Model=analyze.CalculatedModel, ResultFactors=1, ResultCase=-1)  # -> Model, DeformedMesh, DeformedAxes, DeformedModel
panel_3 = Panel(analyze.MaximumDisplacement_cm)
shellview = ShellViewKaramba3D(Model=modelview.Model, IndexOfLayer=0)  # -> Model, MeshesOfRenderedShells, LegendColors, LegendTags
shellview_2 = ShellViewKaramba3D(Model=modelview.Model, IndexOfLayer=0)  # -> Model, MeshesOfRenderedShells, LegendColors, LegendTags

# ----
# Displacement Constraints
expression_7 = Expression(x=panel_3, Expression="x/100")
expression_8 = Expression(x=len_2, Expression="x/250")
item_3 = ListItem(List=expression_8, Index=0, Wrap=True)
actual_displacement_m = Panel(expression_7)
max_allowable_displacement = Panel(item_3)
expression_9 = Expression(x=actual_displacement_m, y=max_allowable_displacement, Expression="x-y")

panel_4 = Panel(shellview_2.LegendTags)
# Stress Constraint
panel_5 = Panel(shellview.LegendTags)
subset = SubList(List=panel_4, Domain="1 to 11", Wrap=True)  # -> flatten(List), Index
subset_2 = SubList(List=panel_5, Domain="1 to 11", Wrap=True)  # -> flatten(List), Index
panel_6 = Panel(subset.List)
panel_7 = Panel(subset_2.List)
bnd = Bounds(Numbers=expr("Abs(x)", panel_6))
bnd_2 = Bounds(Numbers=expr("Abs(x)", panel_7))
dedomain = DeconstructDomain(Domain=bnd)  # -> Start, End
dedomain_2 = DeconstructDomain(Domain=bnd_2)  # -> Start, End
panel_8 = Panel(dedomain.End)
panel_9 = Panel(dedomain_2.End)
max = Maximum(A=panel_9, B=panel_8)
max_actual_stress_kn_cm_2 = Panel(max)
item_4 = ListItem(List=max_actual_stress_kn_cm_2, Index=0, Wrap=True)  # -> Item, Item1
expression_10 = Expression(x=item_4.Item1, Expression="Abs(x*10)")
max_actual_stress_mpa = Panel(expression_10)
max_allowable_stress_mpa = Panel("35")
expression_11 = Expression(x=max_actual_stress_mpa, y=max_allowable_stress_mpa, Expression="x-y")

constrfa = ConstructFishAttribute(Constraint=expression_9)
tunny = Tunny(Variables=number_slider, Objectives=[minimise_embodied_carbon, minimise_cost], Attributes=constrfa)
