# Grasshopper definition Reinforced Concrete Semi-Form Active.gh (Grasshopper 1.0.8)
# plug-ins: Tunny, Karamba3D, Kangaroo2 Components

# ----
# Mesh
mon = Surface(<surface referenced from the Rhino model>)
mplane = MeshPlane(Boundary=mon, WidthCount=Slider(25, range=0..50), HeightCount=Slider(10, range=0..30))  # -> Mesh, Area

# ----
# Movement
explode = Explode(Curve=mon, Recursive=True)  # -> Segments, Vertices
item = ListItem(List=explode.Segments, Index=0, Wrap=True)  # -> Item, Item1, Item2, Item3
crv = Curve(item.Item1)
crv_2 = Curve(item.Item3)
divide = DivideCurve(Curve=crv, Count=Slider(4, range=0..10), Kinks=False)  # -> Points, Tangents, Parameters
divide_2 = DivideCurve(Curve=crv_2, Count=Slider(4, range=0..10), Kinks=False)  # -> Points, Tangents, Parameters
item_2 = ListItem(List=divide.Points, Index=0, Wrap=True)  # -> Item, Item1, Item2, Item3, Item4
item_3 = ListItem(List=divide_2.Points, Index=0, Wrap=True)  # -> Item, Item1, Item2, Item3, Item4
height_2 = Slider(1, range=0..3)
height_1 = Slider(1.4, range=0..3)
height_3 = Slider(1.4, range=0..3)
Z = UnitZ(Factor=height_1)
Z_2 = UnitZ(Factor=height_3)
Z_3 = UnitZ(Factor=height_2)
move = Move(Geometry=item_3.Item1, Motion=Z_2)  # -> Geometry, Transform
move_2 = Move(Geometry=item_3.Item2, Motion=Z_3)  # -> Geometry, Transform
move_3 = Move(Geometry=item_3.Item3, Motion=Z)  # -> Geometry, Transform
move_4 = Move(Geometry=item_2.Item1, Motion=Z)  # -> Geometry, Transform
move_5 = Move(Geometry=item_2.Item3, Motion=Z_2)  # -> Geometry, Transform
move_6 = Move(Geometry=item_2.Item2, Motion=Z_3)  # -> Geometry, Transform
pt = Point(item_3.Item)
pt_2 = Point(item_3.Item4)
pt_3 = Point(item_2.Item)
pt_4 = Point(item_2.Item4)
merge = Merge(Data1=pt_3, Data2=move_4.Geometry, Data3=move_6.Geometry, Data4=move_5.Geometry, Data5=pt_4)
merge_2 = Merge(Data1=pt, Data2=move.Geometry, Data3=move_2.Geometry, Data4=move_3.Geometry, Data5=pt_2)
pline = PolyLine(Vertices=merge, Closed=False)
pline_2 = PolyLine(Vertices=merge_2, Closed=False)
flip = FlipCurve(Curve=pline_2)  # -> Curve, Flag
loft = Loft(
    Curves=[pline, flip.Curve],
    Options={Adjust=False, Closed=False, LoftEnds=0, LoftSimp=0, LoftType=0, Rebuild=10, Refit=0.01})

custom_mesh_settings = SettingsCustom(
    StitchSeams=True,
    SimplePlanes=False,
    Refine=True,
    MinCount=Slider(500, range=1..500),
    MaxCount=400,
    AspectRatio=20,
    MaxDistance=0,
    MaxAngle=20,
    MinEdge=0,
    MaxEdge=0)
mesh = MeshBrep(Brep=loft, Settings=custom_mesh_settings)

nv = NakedVertices(Mesh=mesh)  # -> ClothedIndex, NakedIndex, ClothedPts, NakedPts
# Loads
crv_3 = Curve([<curve referenced from the Rhino model> x2])
incurves = PointInCurves(Point=nv.NakedPts, Curves=crv_3)  # -> Relationship, Index, Point
dispatch = Dispatch(List=nv.NakedPts, DispatchPattern=incurves.Relationship)  # -> ListA, ListB
pt_5 = Point(dispatch.ListA)
supp = SupportKaramba3D(PosInd=pt_5, menu=[buttons(on, on, on, on, on, on)])

# ----
# Supports
number_slider = Slider(25, range=10..100)
# Mesh to Shell (material and cross section)
matselect = MaterialSelectionKaramba3D(menu=[dropdown(7), dropdown(7)])
cross_section = CrossSectionKaramba3D(
    FamilyNameOfCrossSection="DefaultCroSec",
    MaterialConcrete=matselect,
    Height_cm=number_slider,
    ReinforcementAreas_cm2_m=[0, 0, 0, 0],
    ReinforcementConcreteCovers_cm=[3.5, 4.5, -4.5, -3.5],
    PrincipalReinforcementDirection_deg=0,
    mode="Shell RC Standard - Const.")
meshtoshell = MeshToShellKaramba3D(Mesh=mesh, CrossSection=cross_section, LimitDistance_m=0.005)  # -> flatten(Element), Points, Info

# ----
# Calculate Volume
explode_2 = Explode(Curve=mon, Recursive=True)  # -> Segments, Vertices
item_4 = ListItem(List=explode_2.Segments, Index=0, Wrap=True)  # -> Item, Item1, Item2, Item3
slab_depth = Curve(item_4.Item2)
slab_span = Curve(pline_2)
slab_height = Number(number_slider)
len = Length(Curve=slab_depth)
len_2 = Length(Curve=slab_span)
expression = Expression(x=len_2, y=len, z=slab_height, Expression="x*y*(z/100)")
volume_m_3 = Panel(expression)

# ----
# Calculate Weight
density_kg_m_3 = Panel("2500")
expression_2 = Expression(x=density_kg_m_3, y=volume_m_3, Expression="x*y")
weight_kg = Panel(expression_2)

# ----
# Calculate Embodied Carbon
embodied_carbon_per_kg_kgco2e_kg = Panel("1.55")
expression_3 = Expression(x=embodied_carbon_per_kg_kgco2e_kg, y=weight_kg, Expression="x*y")
total_embodied_carbon_kgco2 = Panel(expression_3)

# ----
# Calculate Cost
merge_3 = Merge(Data1=height_1, Data2=height_2, Data3=height_3)
bnd = Bounds(Numbers=merge_3)
number_of_joints = Point(flatten(divide_2.Points))
span = Curve(mon)
dedomain = DeconstructDomain(Domain=bnd)  # -> Start, End
len_3 = Length(Curve=span)
lng = ListLength(List=number_of_joints)
height = Number(dedomain.End)
complexity_factor = Panel("1.5")
price_per_kg_kg = Panel("0.05")
expression_4 = Expression(x=complexity_factor, y=lng, z=height, u=len_3, v=weight_kg, w=price_per_kg_kg, Expression="x*y*z*u*v*w")
price = Panel(expression_4)

minimise_embodied_carbon = Number(total_embodied_carbon_kgco2)
minimise_cost = Number(price)

loads = LoadsKaramba3D(Vector=Vector(0, 0, -1), LCase="0", mode="Gravity")

expression_5 = Expression(x="1.75", Expression="1.5*x")

Z_4 = UnitZ(Factor=expression_5)  # -> expr("-x", UnitVector)
loads_2 = LoadsKaramba3D(Vectors=Z_4, Mesh=mesh, LCase="0", mode="MeshLoad -Variable", menu=[buttons(off, on, off), buttons(on, off)])
panel = Panel(loads_2)

assemble = AssembleModelKaramba3D(Elem=meshtoshell.Element, Support=supp, Load=[loads_2, loads], LimitDistance_m=0.005)  # -> Model, Info, Mass_kg, CenterOfGravity, LoadCaseNames
analyze = AnalyzeKaramba3D(Model=assemble.Model)  # -> flatten(CalculatedModel), flatten(MaximumDisplacement_cm), ResultingForceOfGravity_kN, ElasticEnergyChange_kNm
# Analysis and Results
panel_2 = Panel(assemble.Model)
modelview = ModelViewKaramba3D(Model=analyze.CalculatedModel, ResultFactors=1, ResultCase=-1)  # -> Model, DeformedMesh, DeformedAxes, DeformedModel
panel_3 = Panel(analyze.MaximumDisplacement_cm)
shellview = ShellViewKaramba3D(Model=modelview.Model, IndexOfLayer=0)  # -> Model, MeshesOfRenderedShells, flatten(LegendColors), LegendTags
shellview_2 = ShellViewKaramba3D(Model=modelview.Model, IndexOfLayer=0)  # -> Model, MeshesOfRenderedShells, flatten(LegendColors), LegendTags

panel_4 = Panel(shellview_2.LegendTags)
# Stress Constraint
panel_5 = Panel(shellview.LegendTags)
subset = SubList(List=panel_4, Domain="1 to 11", Wrap=True)  # -> flatten(List), Index
subset_2 = SubList(List=panel_5, Domain="1 to 11", Wrap=True)  # -> flatten(List), Index
panel_6 = Panel(subset.List)
panel_7 = Panel(subset_2.List)
bnd_2 = Bounds(Numbers=expr("Abs(x)", panel_6))
bnd_3 = Bounds(Numbers=expr("Abs(x)", panel_7))
dedomain_2 = DeconstructDomain(Domain=bnd_2)  # -> Start, End
dedomain_3 = DeconstructDomain(Domain=bnd_3)  # -> Start, End
panel_8 = Panel(dedomain_2.End)
panel_9 = Panel(dedomain_3.End)
max = Maximum(A=panel_9, B=panel_8)
max_actual_stress_kn_cm_2 = Panel(max)
item_5 = ListItem(List=max_actual_stress_kn_cm_2, Index=0, Wrap=True)  # -> Item, Item1
expression_6 = Expression(x=item_5.Item1, Expression="Abs(x*10)")
max_actual_stress_mpa = Panel(expression_6)
max_allowable_stress_mpa = Panel("35")
expression_7 = Expression(x=max_actual_stress_mpa, y=max_allowable_stress_mpa, Expression="x-y")

# ----
# Displacement Constraint
item_6 = ListItem(List=panel_3, Index=0, Wrap=True)
expression_8 = Expression(x=item_6, Expression="x/100")
max_allowable_displacement_m = Panel("0.02")
max_actual_displacement_m = Panel(expression_8)
expression_9 = Expression(x=max_actual_displacement_m, y=max_allowable_displacement_m, Expression="x-y")

constrfa = ConstructFishAttribute(Constraint=[expression_9, expression_7])
tunny = Tunny(
    Variables=[number_slider, height_1, height_2, height_3],
    Objectives=[minimise_embodied_carbon, minimise_cost],
    Attributes=constrfa)
