# Grasshopper definition Steel Form Active Improved.gh (Grasshopper 1.0.8)
# plug-ins: Tunny, Karamba3D, LunchBox, Kangaroo2 Components

number_slider = Slider(30, range=1..100)
number_slider_2 = Slider(4, range=1..30)
# Mesh
srf = Surface(<surface referenced from the Rhino model>)
mesh_uv = MeshSurface(Surface=srf, UCount=number_slider, VCount=number_slider_2, Overhang=True, Equalize=False)

# ----
# Create Lower Surface
nv = NakedVertices(Mesh=mesh_uv)  # -> ClothedIndex, NakedIndex, ClothedPts, NakedPts
crv = Curve([<curve referenced from the Rhino model> x2])
incurves = PointInCurves(Point=nv.NakedPts, Curves=crv)  # -> Relationship, Index, Point
dispatch = Dispatch(List=nv.NakedPts, DispatchPattern=incurves.Relationship)  # -> ListA, ListB
lng = ListLength(List=dispatch.ListA)
expression = Expression(x=lng, Expression="x/2")
split = SplitList(List=dispatch.ListA, Index=expression)  # -> ListA, ListB
number_slider_3 = Slider(0.9, range=0.2..1.5)
X = UnitX(Factor=number_slider_3)  # -> expr("-x", UnitVector)
X_2 = UnitX(Factor=number_slider_3)
move = Move(Geometry=split.ListB, Motion=X)  # -> Geometry, Transform
move_2 = Move(Geometry=split.ListA, Motion=X_2)  # -> Geometry, Transform
merge = Merge(Data1=move_2.Geometry, Data2=move.Geometry)
lng_2 = ListLength(List=merge)
expression_2 = Expression(x=lng_2, Expression="x/2")
split_2 = SplitList(List=merge, Index=expression_2)  # -> ListA, ListB
pt = Point(split_2.ListA)
pt_2 = Point(split_2.ListB)
ln = Line(StartPoint=pt, EndPoint=pt_2)
loft = Loft(Curves=ln, Options={Adjust=False, Closed=False, LoftEnds=0, LoftSimp=0, LoftType=0, Rebuild=10, Refit=0.01})
mesh_uv_2 = MeshSurface(Surface=loft, UCount=number_slider_2, VCount=number_slider, Overhang=True, Equalize=False)

number_slider_4 = Slider(0.028, range=0.001..0.05)

# ----
# Top Line Kangaroo
# Bottom Line Kangaroo
nv_2 = NakedVertices(Mesh=mesh_uv)  # -> ClothedIndex, NakedIndex, ClothedPts, NakedPts
crv_2 = Curve([<curve referenced from the Rhino model> x2])
incurves_2 = PointInCurves(Point=nv_2.NakedPts, Curves=crv_2)  # -> Relationship, Index, Point
dispatch_2 = Dispatch(List=nv_2.NakedPts, DispatchPattern=incurves_2.Relationship)  # -> ListA, ListB
pt_3 = Point(dispatch_2.ListA)
pt_4 = Point(nv_2.ClothedPts)
pt_5 = Point(dispatch_2.ListB)
merge_2 = Merge(Data1=pt_4, Data2=pt_5)
Z = UnitZ(Factor=1)
edgelengths = EdgeLengths(Mesh=mesh_uv, LengthFactor=1, Strength=Slider(1, range=0..100))
show = Show(G=mesh_uv)
anchor = Anchor(Point=pt_3, Strength=Slider(100, range=1..100))
load = Load(Point=merge_2, ForceVector=Z, Weighting=number_slider_4)
merge_3 = Merge(Data1=show, Data2=load, Data3=anchor, Data4=edgelengths)
zombiesolver = ZombieSolver(GoalObjects=merge_3, Threshold=1e-10, Tolerance=0.0001, MaxIterations=50000)  # -> I, V, O
panel = Panel(zombiesolver.V)

nv_3 = NakedVertices(Mesh=mesh_uv_2)  # -> ClothedIndex, NakedIndex, ClothedPts, NakedPts
lng_3 = ListLength(List=ln)
expression_3 = Expression(x=lng_3, Expression="x-1")
item = ListItem(List=ln, Index=expression_3, Wrap=True)
item_2 = ListItem(List=ln, Index=0, Wrap=True)  # -> Item, Item1, Item2
divide = DivideCurve(Curve=[item_2.Item, item], Count=number_slider, Kinks=False)  # -> Points, Tangents, Parameters
explode = Explode(Curve=loft, Recursive=True)  # -> Segments, Vertices
lng_4 = ListLength(List=divide.Points)
expression_4 = Expression(x=lng_4, Expression="x-2")
item_3 = ListItem(List=explode.Segments, Index=0, Wrap=True)  # -> Item, Item1, Item2, Item3
crv_3 = Curve([item_3.Item, item_3.Item2])
show_2 = Show(G=mesh_uv_2)
dom = ConstructDomain(DomainStart=Slider(1, range=0..1), DomainEnd=expression_4)
divide_2 = DivideCurve(Curve=crv_3, Count=Slider(137, range=1..200), Kinks=False)  # -> flatten(Points), Tangents, Parameters
subset = SubList(List=divide.Points, Domain=dom, Wrap=True)  # -> List, Index
pt_6 = Point(nv_3.ClothedPts)
pt_7 = Point(subset.List)
edgelengths_2 = EdgeLengths(Mesh=mesh_uv_2, LengthFactor=1, Strength=Slider(1, range=0..100))
merge_4 = Merge(Data1=pt_7, Data2=pt_6)  # -> flatten(Result)
cp = ClosestPoint(Point=divide_2.Points, Cloud=nv_3.NakedPts)  # -> ClosestPoint, CPIndex, Distance
anchor_2 = Anchor(Point=cp.ClosestPoint, Strength=Slider(100, range=1..100))
cp_2 = ClosestPoint(Point=merge_4, Cloud=[nv_3.ClothedPts, nv_3.NakedPts])  # -> ClosestPoint, CPIndex, Distance
Z_2 = UnitZ(Factor=1)
load_2 = Load(Point=cp_2.ClosestPoint, ForceVector=Z_2, Weighting=number_slider_4)
merge_5 = Merge(Data1=show_2, Data2=load_2, Data3=anchor_2, Data4=edgelengths_2)
zombiesolver_2 = ZombieSolver(GoalObjects=merge_5, Threshold=1e-10, Tolerance=0.0001, MaxIterations=50000)  # -> I, V, O
panel_2 = Panel(zombiesolver_2.V)

# ----
# Sorting Coordinates
pt_8 = Point(panel)
pdecon = Deconstruct(Point=pt_8)  # -> XComponent, YComponent, ZComponent
sort = SortList(Keys=pdecon.YComponent, ValuesA=pt_8)  # -> Keys, ValuesA
partition = PartitionList(List=sort.ValuesA, Size=expr("x+1", number_slider))
pdecon_2 = Deconstruct(Point=partition)  # -> XComponent, YComponent, ZComponent
sort_2 = SortList(Keys=pdecon_2.XComponent, ValuesA=partition)  # -> Keys, ValuesA
intcrv = Interpolate(Vertices=sort_2.ValuesA, Degree=3, Periodic=False, KnotStyle=1)  # -> Curve, Length, Domain

# ----
# Sorting Coordinates
pt_9 = Point(panel_2)
pdecon_3 = Deconstruct(Point=pt_9)  # -> XComponent, YComponent, ZComponent
sort_3 = SortList(Keys=pdecon_3.YComponent, ValuesA=pt_9)  # -> Keys, ValuesA
partition_2 = PartitionList(List=sort_3.ValuesA, Size=expr("x+1", number_slider))
pdecon_4 = Deconstruct(Point=partition_2)  # -> XComponent, YComponent, ZComponent
sort_4 = SortList(Keys=pdecon_4.XComponent, ValuesA=partition_2)  # -> Keys, ValuesA
intcrv_2 = Interpolate(Vertices=sort_4.ValuesA, Degree=3, Periodic=False, KnotStyle=1)  # -> Curve, Length, Domain

number_slider_5 = Slider(15, range=2..15)
truss = _2DTruss(CurveA=reverse(intcrv.Curve), CurveB=intcrv_2.Curve, Divisions=number_slider_5, TrussToggle=Slider(0, range=0..2))  # -> PrimaryLines, BraceLines, VerticalLines, StructureNodes

matprops = MaterialPropertiesKaramba3D(
    FamilyOfMaterial="Steel",
    Name="S235",
    YoungsModulus_kN_cm2="21000",
    InPlaneShearModulus_kN_cm2="8100",
    TransverseShearModulus_kN_cm2="8100",
    SpecificWeight_kN_m3="78.5",
    CoefficientOfThermalExpansion_1_C="0.000012",
    TensileStrength_kN_cm2="35.5",
    CompressiveStrength_kN_cm2="-35.5",
    StrengthHypothesis="MISES",
    mode="Isotrop")

crv_4 = Curve([truss.BraceLines, truss.VerticalLines, truss.PrimaryLines])
linetobeam = LineToBeamKaramba3D(
    Line=crv_4,
    New=True,
    Remove=True,
    LimitDistance_m=0.005,
    Bending=Toggle(False),
    SetBucklingLength=True,
    ToPolylineMaxAngle=0.03,
    ToPolylineTolerance=0.01,
    ToPolylineMaxEdgeLength=0.25)  # -> Element, Points, Info
pt_10 = Point(truss.StructureNodes)
mplane = MeshPlane(Boundary=srf, WidthCount=number_slider_2, HeightCount=10)  # -> Mesh, Area
lng_5 = ListLength(List=pt_10)
lng_6 = ListLength(List=pt_10)
expression_5 = Expression(x=lng_6, Expression="x-2")
expression_6 = Expression(x=lng_5, Expression="x-1")
item_4 = ListItem(List=pt_10, Index=expression_5, Wrap=True)
item_5 = ListItem(List=pt_10, Index=expression_6, Wrap=True)
item_6 = ListItem(List=pt_10, Index=0, Wrap=True)  # -> Item, Item1
item_7 = ListItem(List=pt_10, Index=0, Wrap=True)
number_slider_6 = Slider(9.3, range=1..10)
number_slider_7 = Slider(6, range=5..50)
number_slider_8 = Slider(19, range=10..100)
Z_3 = UnitZ(Factor=1)
pt_11 = Point(item_7)
pt_12 = Point(item_4)
pt_13 = Point(item_5)
pt_14 = Point(item_6.Item1)
move_3 = Move(Geometry=mplane.Mesh, Motion=Z_3)  # -> Geometry, Transform
merge_6 = Merge(Data1=pt_14, Data2=pt_13, Data3=pt_11, Data4=pt_12)
supp = SupportKaramba3D(PosInd=merge_6, menu=[buttons(on, on, on, on, on, on)])
cross_section = CrossSectionKaramba3D(
    FamilyNameOfCrossSection="DefaultCroSec",
    Height_cm=number_slider_8,
    UpperFlangeWidth_cm=number_slider_7,
    LowerFlangeWidth_cm=number_slider_7,
    UpperFlangeThickness_cm=number_slider_6,
    LowerFlangeThickness_cm=number_slider_6,
    SidewallsThickness_cm=0.4,
    FilletRadius_cm=0.6,
    mode="Box")
loads = LoadsKaramba3D(Vector=Vector(0, 0, -1), LCase="0", mode="Gravity")

expression_7 = Expression(x="-0.4", Expression="1.5*x")

Z_4 = UnitZ(Factor=expression_7)
loads_2 = LoadsKaramba3D(Vector=Z_4, Mesh=move_3.Geometry, LCase="0", mode="MeshLoad -Const.", menu=[buttons(on, off, off), buttons(on, off)])
assemble = AssembleModelKaramba3D(
    Point=truss.StructureNodes,
    Elem=linetobeam.Element,
    Support=supp,
    Load=[loads, loads_2],
    CrossSection=cross_section,
    Material=matprops,
    LimitDistance_m=0.005)  # -> flatten(Model), Info, Mass_kg, CenterOfGravity, LoadCaseNames

# ----
# Calculate Volume
cross_section_height = Number(number_slider_8)
cross_section_width = Number(number_slider_7)
number_of_lines = Number(number_slider_2)
thickness = Number(number_slider_6)
horizontal_lines = Curve(truss.PrimaryLines)
diagonal_lines = Curve(truss.BraceLines)
vertical_lines = Curve(truss.VerticalLines)
len = Length(Curve=horizontal_lines)
lng_7 = ListLength(List=vertical_lines)
lng_8 = ListLength(List=diagonal_lines)
len_2 = Length(Curve=vertical_lines)
len_3 = Length(Curve=diagonal_lines)
lng_9 = ListLength(List=horizontal_lines)
expression_8 = Expression(
    x=cross_section_width,
    y=cross_section_height,
    w=thickness,
    z=len_2,
    u=lng_7,
    v=number_of_lines,
    Expression="((((x/100)*(w/100))+((y/100)*(w/100)))*z*(u*(v+1)))")  # -> flatten(R)
expression_9 = Expression(
    x=cross_section_width,
    y=cross_section_height,
    w=thickness,
    z=len_3,
    u=lng_8,
    v=number_of_lines,
    Expression="((((x/100)*(w/100))+((y/100)*(w/100)))*z*(u*(v+1)))")  # -> flatten(R)
expression_10 = Expression(
    x=cross_section_width,
    y=cross_section_height,
    w=thickness,
    z=len,
    u=lng_9,
    v=number_of_lines,
    Expression="((((x/100)*(w/100))+((y/100)*(w/100)))*z*(u*(v+1)))")  # -> flatten(R)
item_8 = ListItem(List=expression_8, Index=0, Wrap=True)
item_9 = ListItem(List=expression_9, Index=0, Wrap=True)
item_10 = ListItem(List=expression_10, Index=0, Wrap=True)
expression_11 = Expression(x=item_10, y=item_9, z=item_8, Expression="x+y+z")
volume_m_3 = Panel(expression_11)

analyze = AnalyzeKaramba3D(Model=assemble.Model)  # -> flatten(CalculatedModel), flatten(MaximumDisplacement_cm), ResultingForceOfGravity_kN, ElasticEnergyChange_kNm
modelview = ModelViewKaramba3D(Model=flatten(analyze.CalculatedModel), ResultFactors=1, ResultCase=-1)  # -> flatten(Model), DeformedMesh, DeformedAxes, DeformedModel
beamview = BeamViewKaramba3D(Model=modelview.Model)  # -> Model, MeshesOfRenderedBeams, DeformedBeamAxes, flatten(LegendColors), flatten(LegendTags)
panel_3 = Panel(analyze.MaximumDisplacement_cm)
panel_4 = Panel(beamview.LegendTags)

# ----
# Stress
item_11 = ListItem(List=panel_4, Index=0, Wrap=True)  # -> Item, Item1
expression_12 = Expression(x=item_11.Item1, Expression="Abs(x*100)")
max_allowable_stress = Panel("355")
actual_stress_n_mm_2 = Panel(expression_12)

# ----
# Displacement
lng_10 = ListLength(List=panel_3)
expression_13 = Expression(x=lng_10, Expression="x/2")
item_12 = ListItem(List=panel_3, Index=expression_13, Wrap=True)
expression_14 = Expression(x=item_12, Expression="x/100")
max_allowable_displacement_m = Panel("0.025")
actual_displacement_m = Panel(expression_14)

# ----
# Calculate Weight
density_kg_m_3 = Panel("390")
expression_15 = Expression(x=density_kg_m_3, y=volume_m_3, Expression="x*y")
weight_kg = Panel(expression_15)

expression_16 = Expression(x=actual_stress_n_mm_2, y=max_allowable_stress, Expression="x-y")
expression_17 = Expression(x=actual_displacement_m, y=max_allowable_displacement_m, Expression="x-y")

explode_2 = Explode(Curve=srf, Recursive=True)  # -> Segments, Vertices
# Calculate Cost
number_of_joints = Point(flatten(truss.StructureNodes))
item_13 = ListItem(List=explode_2.Segments, Index=0, Wrap=True)  # -> Item, Item1, Item2, Item3
lng_11 = ListLength(List=number_of_joints)
expression_18 = Expression(x=lng_11, Expression="x/2")
span = Curve(item_13.Item3)
item_14 = ListItem(List=number_of_joints, Index=expression_18, Wrap=True)
len_4 = Length(Curve=span)
pdecon_5 = Deconstruct(Point=item_14)  # -> XComponent, YComponent, ZComponent
complexity_factor = Panel("2.25")
height = Number(pdecon_5.ZComponent)
price_per_kg_kg = Panel("0.825")
expression_19 = Expression(x=complexity_factor, y=lng_11, z=height, u=len_4, v=weight_kg, w=price_per_kg_kg, Expression="x*y*z*u*v*w")
price = Panel(expression_19)

# ----
# Calculate Embodied Carbon
embodied_carbon_kgco2e_kg = Panel("1.55")
expression_20 = Expression(x=embodied_carbon_kgco2e_kg, y=weight_kg, Expression="x*y")
total_embodied_carbon_kgco2e = Panel(expression_20)

constrfa = ConstructFishAttribute(Constraint=[expression_17, expression_16])
minimize_embodied_carbon = Number(total_embodied_carbon_kgco2e)
minimize_cost = Number(price)
tunny = Tunny(
    Variables=[number_slider_8, number_slider_7, number_slider_6, number_slider_5],
    Objectives=[minimize_cost, minimize_embodied_carbon],
    Attributes=constrfa)
