# Grasshopper definition Steel Non-Form Active Improved.gh (Grasshopper 1.0.8)
# plug-ins: Tunny, Karamba3D, LunchBox

# ----
# Horizontal Lines
srf = Surface(reparameterize(<surface referenced from the Rhino model>))
Z = UnitZ(Factor=Slider(0.5, range=0.5..3))
move = Move(Geometry=srf, Motion=Z)  # -> Geometry, Transform
explode = Explode(Curve=move.Geometry, Recursive=True)  # -> Segments, Vertices
explode_2 = Explode(Curve=srf, Recursive=True)  # -> Segments, Vertices
item = ListItem(List=explode_2.Segments, Index=0, Wrap=True)  # -> Item, Item1, Item2
item_2 = ListItem(List=explode.Segments, Index=0, Wrap=True)  # -> Item, Item1, Item2, Item3
number_slider = Slider(6, range=1..30)
flip = FlipCurve(Curve=item_2.Item2)  # -> Curve, Flag
flip_2 = FlipCurve(Curve=item.Item)  # -> Curve, Flag
divide = DivideCurve(Curve=flip_2.Curve, Count=number_slider, Kinks=False)  # -> Points, Tangents, Parameters
divide_2 = DivideCurve(Curve=item.Item2, Count=number_slider, Kinks=False)  # -> Points, Tangents, Parameters
divide_3 = DivideCurve(Curve=item_2.Item, Count=number_slider, Kinks=False)  # -> Points, Tangents, Parameters
divide_4 = DivideCurve(Curve=flip.Curve, Count=number_slider, Kinks=False)  # -> Points, Tangents, Parameters
ln = Line(StartPoint=divide.Points, EndPoint=divide_2.Points)
ln_2 = Line(StartPoint=divide_3.Points, EndPoint=divide_4.Points)

# ----
# Move Top Line
number_slider_2 = Slider(4, range=0..10)
divide_5 = DivideCurve(Curve=ln_2, Count=number_slider_2, Kinks=False)  # -> Points, Tangents, Parameters
item_3 = ListItem(List=divide_5.Points, Index=0, Wrap=True)  # -> Item, Item1, Item2, Item3, Item4
number_slider_3 = Slider(0.4, range=0..3)
number_slider_4 = Slider(2.5, range=0..3)
number_slider_5 = Slider(2.5, range=0..3)
number_slider_6 = Slider(0.4, range=0..3)
number_slider_7 = Slider(2.8, range=0..3)
Z_2 = UnitZ(Factor=number_slider_5)
Z_3 = UnitZ(Factor=number_slider_3)
Z_4 = UnitZ(Factor=number_slider_4)
Z_5 = UnitZ(Factor=number_slider_7)
Z_6 = UnitZ(Factor=number_slider_6)
move_2 = Move(Geometry=item_3.Item4, Motion=Z_3)  # -> Geometry, Transform
move_3 = Move(Geometry=item_3.Item3, Motion=Z_2)  # -> Geometry, Transform
move_4 = Move(Geometry=item_3.Item2, Motion=Z_5)  # -> Geometry, Transform
move_5 = Move(Geometry=item_3.Item, Motion=Z_6)  # -> Geometry, Transform
move_6 = Move(Geometry=item_3.Item1, Motion=Z_4)  # -> Geometry, Transform
merge = Merge(Data1=move_5.Geometry, Data2=move_6.Geometry, Data3=move_4.Geometry, Data4=move_3.Geometry, Data5=move_2.Geometry)
pline = PolyLine(Vertices=merge, Closed=False)  # -> flatten(Polyline)

# ----
# Make Truss
number_slider_8 = Slider(3, range=2..15)
truss = _2DTruss(CurveA=reverse(ln), CurveB=pline, Divisions=number_slider_8, TrussToggle=Slider(0, range=0..2))  # -> PrimaryLines, BraceLines, VerticalLines, StructureNodes

number_slider_9 = Slider(5.1, range=1..10)
matprops = MaterialPropertiesKaramba3D(
    FamilyOfMaterial="Steel",
    Name="S235",
    YoungsModulus_kN_cm2="21000",
    InPlaneShearModulus_kN_cm2="8100",
    TransverseShearModulus_kN_cm2="8100",
    SpecificWeight_kN_m3="78.5",
    CoefficientOfThermalExpansion_1_C="0.000012",
    TensileStrength_kN_cm2="35.5",
    CompressiveStrength_kN_cm2="-35.5",
    StrengthHypothesis="MISES",
    mode="Isotrop")
number_of_lines = Number(number_slider)
thickness = Number(number_slider_9)
len = Length(Curve=ln)
expression = Expression(x=len, Expression="x/200")
item_4 = ListItem(List=expression, Index=0, Wrap=True)

# ----
# Assemble Model
crv = Curve([truss.BraceLines, truss.VerticalLines, truss.PrimaryLines])
mplane = MeshPlane(Boundary=srf, WidthCount=number_slider, HeightCount=10)  # -> Mesh, Area
linetobeam = LineToBeamKaramba3D(
    Line=crv,
    New=True,
    Remove=True,
    LimitDistance_m=0.005,
    Bending=Toggle(False),
    SetBucklingLength=True,
    ToPolylineMaxAngle=0.03,
    ToPolylineTolerance=0.01,
    ToPolylineMaxEdgeLength=0.25)  # -> Element, Points, Info
Z_7 = UnitZ(Factor=1)
pt = Point(truss.StructureNodes)
number_slider_10 = Slider(34, range=5..50)
move_7 = Move(Geometry=mplane.Mesh, Motion=Z_7)  # -> Geometry, Transform
lng = ListLength(List=pt)
number_slider_11 = Slider(59, range=10..100)
expression_2 = Expression(x=lng, Expression="x-2")
item_5 = ListItem(List=pt, Index=expression_2, Wrap=True)
item_6 = ListItem(List=pt, Index=0, Wrap=True)
cross_section = CrossSectionKaramba3D(
    FamilyNameOfCrossSection="DefaultCroSec",
    Height_cm=number_slider_11,
    UpperFlangeWidth_cm=number_slider_10,
    LowerFlangeWidth_cm=number_slider_10,
    UpperFlangeThickness_cm=number_slider_9,
    LowerFlangeThickness_cm=number_slider_9,
    SidewallsThickness_cm=0.4,
    FilletRadius_cm=0.6,
    mode="Box")
supp = SupportKaramba3D(PosInd=[item_5, item_6], menu=[buttons(on, on, on, on, on, on)])
loads = LoadsKaramba3D(Vector=Vector(0, 0, -1), LCase="0", mode="Gravity")

expression_3 = Expression(x="-0.4", Expression="1.5*x")

Z_8 = UnitZ(Factor=expression_3)
loads_2 = LoadsKaramba3D(Vector=Z_8, Mesh=move_7.Geometry, LCase="0", mode="MeshLoad -Const.", menu=[buttons(on, off, off), buttons(on, off)])
assemble = AssembleModelKaramba3D(
    Point=truss.StructureNodes,
    Elem=linetobeam.Element,
    Support=supp,
    Load=[loads, loads_2],
    CrossSection=cross_section,
    Material=matprops,
    LimitDistance_m=0.005)  # -> flatten(Model), Info, Mass_kg, CenterOfGravity, LoadCaseNames

cross_section_height = Number(number_slider_11)
cross_section_width = Number(number_slider_10)

# ----
# Analysis and Results
analyze = AnalyzeKaramba3D(Model=assemble.Model)  # -> flatten(CalculatedModel), flatten(MaximumDisplacement_cm), ResultingForceOfGravity_kN, ElasticEnergyChange_kNm
modelview = ModelViewKaramba3D(Model=flatten(analyze.CalculatedModel), ResultFactors=1, ResultCase=-1)  # -> flatten(Model), DeformedMesh, DeformedAxes, DeformedModel
beamview = BeamViewKaramba3D(Model=modelview.Model)  # -> Model, MeshesOfRenderedBeams, DeformedBeamAxes, flatten(LegendColors), flatten(LegendTags)
panel = Panel(analyze.MaximumDisplacement_cm)
panel_2 = Panel(beamview.LegendTags)

# ----
# Calculate Volume
horizontal_lines = Curve(truss.PrimaryLines)
diagonal_lines = Curve(truss.BraceLines)
vertical_lines = Curve(truss.VerticalLines)
lng_2 = ListLength(List=vertical_lines)
lng_3 = ListLength(List=diagonal_lines)
len_2 = Length(Curve=vertical_lines)
len_3 = Length(Curve=horizontal_lines)
len_4 = Length(Curve=diagonal_lines)
lng_4 = ListLength(List=horizontal_lines)
expression_4 = Expression(
    x=cross_section_width,
    y=cross_section_height,
    w=thickness,
    z=len_2,
    u=lng_2,
    v=number_of_lines,
    Expression="((((x/100)*(w/100))+((y/100)*(w/100)))*z*(u*(v+1)))")  # -> flatten(R)
expression_5 = Expression(
    x=cross_section_width,
    y=cross_section_height,
    w=thickness,
    z=len_4,
    u=lng_3,
    v=number_of_lines,
    Expression="((((x/100)*(w/100))+((y/100)*(w/100)))*z*(u*(v+1)))")  # -> flatten(R)
expression_6 = Expression(
    x=cross_section_width,
    y=cross_section_height,
    w=thickness,
    z=len_3,
    u=lng_4,
    v=number_of_lines,
    Expression="(((x/100)*(w/100))+((y/100)*(w/100)))*z*(u*(v+1))")  # -> flatten(R)
item_7 = ListItem(List=expression_4, Index=0, Wrap=True)
item_8 = ListItem(List=expression_6, Index=0, Wrap=True)
item_9 = ListItem(List=expression_5, Index=0, Wrap=True)
expression_7 = Expression(x=item_8, y=item_9, z=item_7, Expression="x+y+z")
volume_m_3 = Panel(expression_7)

# ----
# Constraints
lng_5 = ListLength(List=panel)
item_10 = ListItem(List=panel_2, Index=0, Wrap=True)  # -> Item, Item1
expression_8 = Expression(x=lng_5, Expression="x/2")
expression_9 = Expression(x=item_10.Item1, Expression="Abs(x*10)")
item_11 = ListItem(List=panel, Index=expression_8, Wrap=True)
expression_10 = Expression(x=item_11, Expression="x/100")
max_allowable_stress = Panel("355")
actual_stress_n_mm_2 = Panel(expression_9)
max_allowable_displacement_m = Panel("0.025")
actual_displacement_m = Panel(expression_10)
expression_11 = Expression(x=actual_stress_n_mm_2, y=max_allowable_stress, Expression="x-y")
expression_12 = Expression(x=actual_displacement_m, y=max_allowable_displacement_m, Expression="x-y")

# ----
# Calculate Weight
density_kg_m_3 = Panel("390")
expression_13 = Expression(x=density_kg_m_3, y=volume_m_3, Expression="x*y")
weight_kg = Panel(expression_13)

# ----
# Calculate Embodied Carbon
embodied_carbon_kgco2e_kg = Panel("1.55")
expression_14 = Expression(x=embodied_carbon_kgco2e_kg, y=weight_kg, Expression="x*y")
total_embodied_carbon_kgco2e = Panel(expression_14)

# ----
# Calculate Cost
merge_2 = Merge(Data1=number_slider_6, Data2=number_slider_4, Data3=number_slider_7, Data4=number_slider_5, Data5=number_slider_3)
bnd = Bounds(Numbers=merge_2)
number_of_joints = Point(flatten(truss.StructureNodes))
span = Curve(item_2.Item3)
dedomain = DeconstructDomain(Domain=bnd)  # -> Start, End
len_5 = Length(Curve=span)
lng_6 = ListLength(List=number_of_joints)
height = Number(dedomain.End)
complexity_factor = Panel("1.25")
price_per_kg_kg = Panel("1.06")
expression_15 = Expression(x=complexity_factor, y=lng_6, z=height, u=len_5, v=weight_kg, w=price_per_kg_kg, Expression="x*y*z*u*v*w")
price = Panel(expression_15)

constrfa = ConstructFishAttribute(Constraint=[expression_12, expression_11])
fishattr = FishAttribute(constrfa)
minimize_embodied_carbon = Number(total_embodied_carbon_kgco2e)
minimize_cost = Number(price)
tunny = Tunny(
    Variables=[number_slider, number_slider_11, number_slider_10, number_slider_9, number_slider_8, number_slider_6, number_slider_4, number_slider_7, number_slider_5, number_slider_3],
    Objectives=[minimize_embodied_carbon, minimize_cost],
    Attributes=fishattr)
