# Grasshopper definition Steel Non-Form Active.gh (Grasshopper 1.0.8)
# plug-ins: Tunny, Karamba3D

# ----
# Horizontal Line
srf = Surface(<surface referenced from the Rhino model>)
explode = Explode(Curve=srf, Recursive=True)  # -> Segments, Vertices
item = ListItem(List=explode.Segments, Index=0, Wrap=True)  # -> Item, Item1, Item2, Item3
number_slider = Slider(1, range=1..20)
crv = Curve(item.Item2)
crv_2 = Curve(item.Item)
flip = FlipCurve(Curve=crv_2)  # -> Curve, Flag
divide = DivideCurve(Curve=crv, Count=number_slider, Kinks=False)  # -> Points, Tangents, Parameters
divide_2 = DivideCurve(Curve=flip.Curve, Count=number_slider, Kinks=False)  # -> Points, Tangents, Parameters
ln = Line(StartPoint=divide_2.Points, EndPoint=divide.Points)

matprops = MaterialPropertiesKaramba3D(
    FamilyOfMaterial="Steel",
    Name="S235",
    YoungsModulus_kN_cm2="21000",
    InPlaneShearModulus_kN_cm2="8100",
    TransverseShearModulus_kN_cm2="8100",
    SpecificWeight_kN_m3="78.5",
    CoefficientOfThermalExpansion_1_C="0.000012",
    TensileStrength_kN_cm2="35.5",
    CompressiveStrength_kN_cm2="-35.5",
    StrengthHypothesis="MISES",
    mode="Isotrop")
len = Length(Curve=ln)  # -> flatten(Length)
expression = Expression(x=len, Expression="x/200")
item_2 = ListItem(List=expression, Index=0, Wrap=True)

number_slider_2 = Slider(31, range=10..200)
number_slider_3 = Slider(0.4, range=0.1..10)
number_slider_4 = Slider(29, range=5..50)
mplane = MeshPlane(Boundary=srf, WidthCount=number_slider, HeightCount=10)  # -> Mesh, Area
# Assemble Model
supp = SupportKaramba3D(PosInd=[divide_2.Points, divide.Points], menu=[buttons(on, on, on, on, on, on)])
linetobeam = LineToBeamKaramba3D(
    Line=ln,
    New=True,
    Remove=True,
    LimitDistance_m=0.005,
    Bending=True,
    SetBucklingLength=True,
    ToPolylineMaxAngle=0.03,
    ToPolylineTolerance=0.01,
    ToPolylineMaxEdgeLength=0.25)  # -> Element, Points, Info
cross_section = CrossSectionKaramba3D(
    FamilyNameOfCrossSection="DefaultCroSec",
    Height_cm=number_slider_2,
    UpperFlangeWidth_cm=number_slider_4,
    LowerFlangeWidth_cm=number_slider_4,
    UpperFlangeThickness_cm=number_slider_3,
    LowerFlangeThickness_cm=number_slider_3,
    WebThickness_cm=number_slider_3,
    FilletRadius_cm=0,
    mode="I")

expression_2 = Expression(x="0.4", Expression="1.5*x")

Z = UnitZ(Factor=expression_2)  # -> expr("-x", UnitVector)
loads = LoadsKaramba3D(Vector=Z, Mesh=mplane.Mesh, LCase="0", mode="MeshLoad -Const.", menu=[buttons(on, off, off), buttons(off, on)])
assemble = AssembleModelKaramba3D(Elem=linetobeam.Element, Support=supp, Load=loads, CrossSection=cross_section, Material=matprops, LimitDistance_m=0.005)  # -> Model, Info, Mass_kg, CenterOfGravity, LoadCaseNames

# ----
# Analysis and Results
analyze = AnalyzeKaramba3D(Model=assemble.Model)  # -> CalculatedModel, MaximumDisplacement_cm, ResultingForceOfGravity_kN, ElasticEnergyChange_kNm
modelview = ModelViewKaramba3D(Model=analyze.CalculatedModel, ResultFactors=1, ResultCase=-1)  # -> Model, DeformedMesh, DeformedAxes, DeformedModel
beamview = BeamViewKaramba3D(Model=modelview.Model)  # -> Model, MeshesOfRenderedBeams, DeformedBeamAxes, LegendColors, LegendTags
legend = Legend(Colour=beamview.LegendColors, Tags=beamview.LegendTags, LegendType=1)

# ----
# Calculate Volume
crv_3 = Curve(item.Item1)
len_2 = Length(Curve=crv_3)
panel = Panel(len_2)
expression_3 = Expression(
    x=number_slider_3,
    v=number_slider_2,
    y=number_slider_4,
    z=panel,
    u=number_slider,
    Expression="(((x/100)*(v/100))+(2*(x/100)*(y/100)))*z*(u+1)")
volume_m_3 = Panel(expression_3)

# ----
# Calculate Weight
density_kg_m_3 = Panel("390")
expression_4 = Expression(x=density_kg_m_3, y=volume_m_3, Expression="x*y")
weight_kg = Panel(expression_4)

panel_2 = Panel(beamview.LegendTags)
# Constraints
expression_5 = Expression(x=analyze.MaximumDisplacement_cm, Expression="x/100")
item_3 = ListItem(List=panel_2, Index=0, Wrap=True)  # -> Item, Item1
expression_6 = Expression(x=item_3.Item1, Expression="Abs(x*10)")
actual_displacement_m = Panel(expression_5)
max_allowable_displacement = Panel(item_2)
max_allowable_stress_mpa = Panel("355")
max_actual_stress_mpa = Panel(expression_6)
expression_7 = Expression(x=actual_displacement_m, y=max_allowable_displacement, Expression="x-y")
expression_8 = Expression(x=max_actual_stress_mpa, y=max_allowable_stress_mpa, Expression="x-y")
constrfa = ConstructFishAttribute(Constraint=[expression_7, expression_8])

# ----
# Calculate Embodied Carbon
embodied_carbon_per_kg_kgco2e_kg = Panel("1.55")
expression_9 = Expression(x=embodied_carbon_per_kg_kgco2e_kg, y=weight_kg, Expression="x*y")
total_embodied_carbon_kgco2 = Panel(expression_9)

# ----
# Calculate Cost
merge = Merge(Data1=divide_2.Points, Data2=divide.Points)
expression_10 = Expression(x=number_slider_2, Expression="x/100")
number_of_joints = Point(flatten(merge))
span = Curve(item.Item3)
len_3 = Length(Curve=span)
lng = ListLength(List=number_of_joints)
height = Number(expression_10)
complexity_factor = Panel("1")
price_per_kg_kg = Panel("1.06")
expression_11 = Expression(x=complexity_factor, y=lng, z=height, u=len_3, v=weight_kg, w=price_per_kg_kg, Expression="x*y*z*u*v*w")
price = Panel(expression_11)

wlc_minimize_embodied_carbon = Number(total_embodied_carbon_kgco2)
wlc_minimize_cost = Number(price)
tunny = Tunny(
    Variables=[number_slider, number_slider_4, number_slider_2, number_slider_3],
    Objectives=[wlc_minimize_embodied_carbon, wlc_minimize_cost],
    Attributes=constrfa)
deconf = DeconstructFish(Fishes=tunny)  # -> Variables, Objectives, Attributes
panel_3 = Panel(tunny)
panel_4 = Panel(deconf.Objectives)
panel_5 = Panel(deconf.Variables)
