# Grasshopper definition Timber Form Active.gh (Grasshopper 1.0.8)
# plug-ins: Tunny, Karamba3D, Kangaroo2 Components

number_slider = Slider(5, range=1..30)
number_slider_2 = Slider(30, range=1..100)
# Mesh
srf = Surface(<surface referenced from the Rhino model>)
mesh_uv = MeshSurface(Surface=srf, UCount=number_slider_2, VCount=number_slider, Overhang=True, Equalize=False)

number_slider_3 = Slider(0.004, range=0.001..0.05)

# ----
# Kangaroo
nv = NakedVertices(Mesh=mesh_uv)  # -> ClothedIndex, NakedIndex, ClothedPts, NakedPts
crv = Curve([<curve referenced from the Rhino model> x2])
incurves = PointInCurves(Point=nv.NakedPts, Curves=crv)  # -> Relationship, Index, Point
dispatch = Dispatch(List=nv.NakedPts, DispatchPattern=incurves.Relationship)  # -> ListA, ListB
pt = Point(nv.ClothedPts)
pt_2 = Point(dispatch.ListB)
merge = Merge(Data1=pt, Data2=pt_2)
pt_3 = Point(dispatch.ListA)
Z = UnitZ(Factor=1)
edgelengths = EdgeLengths(Mesh=mesh_uv, LengthFactor=1, Strength=Slider(1, range=0..100))
show = Show(G=mesh_uv)
anchor = Anchor(Point=pt_3, Strength=Slider(100, range=1..100))
load = Load(Point=merge, ForceVector=Z, Weighting=number_slider_3)
merge_2 = Merge(Data1=show, Data2=load, Data3=anchor, Data4=edgelengths)

zombiesolver = ZombieSolver(GoalObjects=merge_2, Threshold=1e-10, Tolerance=0.0001, MaxIterations=50000)  # -> I, V, O

panel = Panel(zombiesolver.V)

# ----
# Sorting Coordinates
pt_4 = Point(panel)
pdecon = Deconstruct(Point=pt_4)  # -> XComponent, YComponent, ZComponent
sort = SortList(Keys=pdecon.YComponent, ValuesA=pt_4)  # -> Keys, ValuesA
partition = PartitionList(List=sort.ValuesA, Size=expr("x+1", number_slider_2))
pdecon_2 = Deconstruct(Point=partition)  # -> XComponent, YComponent, ZComponent
sort_2 = SortList(Keys=pdecon_2.XComponent, ValuesA=partition)  # -> Keys, ValuesA
intcrv = Interpolate(Vertices=sort_2.ValuesA, Degree=3, Periodic=False, KnotStyle=1)  # -> Curve, Length, Domain

depth_m = Panel("30")
expression = Expression(x=depth_m, y=number_slider, z=Slider(5, range=5..100), Expression="(x/y)*z")
imposed_load_kn_m_2 = Panel("0.4")
loaded_area_for_inner_beams_m_2 = Panel(expression)
number_slider_4 = Slider(14, range=1..250)
number_slider_5 = Slider(71, range=1..250)
# Assemble Model
explode = Explode(Curve=intcrv.Curve, Recursive=True)  # -> Segments, Vertices
pt_5 = Point(explode.Vertices)
supp = SupportKaramba3D(PosInd=pt_5, menu=[buttons(on, on, on, on, on, on)])
cross_section = CrossSectionKaramba3D(
    FamilyNameOfCrossSection="DefaultCroSec",
    Height_cm=number_slider_5,
    UpperFlangeWidth_cm=number_slider_4,
    LowerFlangeWidth_cm=number_slider_4,
    mode="Trapezoid")
matselect = MaterialSelectionKaramba3D(menu=[dropdown(2), dropdown(1)])
linetobeam = LineToBeamKaramba3D(
    Line=intcrv.Curve,
    New=True,
    Remove=True,
    LimitDistance_m=0.005,
    Bending=True,
    SetBucklingLength=True,
    ToPolylineMaxAngle=0.03,
    ToPolylineTolerance=0.01,
    ToPolylineMaxEdgeLength=0.25)  # -> Element, Points, Info
loads = LoadsKaramba3D(Vector=Vector(0, 0, -1), LCase="0", mode="Gravity")

expression_2 = Expression(x=imposed_load_kn_m_2, Expression="1.5*x")

expression_3 = Expression(x=expression_2, y=loaded_area_for_inner_beams_m_2, Expression="x*y")
load_inner_beams_kn = Panel(expression_3)
Z_2 = UnitZ(Factor=load_inner_beams_kn)  # -> expr("-x", UnitVector)
beam_loads = BeamLoadsKaramba3D(LoadCase="0", ForceVector=Z_2, TStart=0, TEnd=1, mode="Block", menu=[buttons(off, on, off)])  # -> flatten(Load)

assemble = AssembleModelKaramba3D(
    Elem=linetobeam.Element,
    Support=supp,
    Load=[loads, beam_loads],
    CrossSection=cross_section,
    Material=matselect,
    LimitDistance_m=0.005)  # -> Model, Info, Mass_kg, CenterOfGravity, LoadCaseNames

# ----
# Analysis and Results
analyze = AnalyzeKaramba3D(Model=assemble.Model)  # -> flatten(CalculatedModel), MaximumDisplacement_cm, ResultingForceOfGravity_kN, ElasticEnergyChange_kNm
modelview = ModelViewKaramba3D(Model=analyze.CalculatedModel, ResultFactors=1, ResultCase=-1)  # -> flatten(Model), DeformedMesh, DeformedAxes, DeformedModel
beamview = BeamViewKaramba3D(Model=modelview.Model)  # -> Model, MeshesOfRenderedBeams, DeformedBeamAxes, flatten(LegendColors), flatten(LegendTags)
legend = Legend(Colour=beamview.LegendColors, Tags=beamview.LegendTags, LegendType=1)

# ----
# Displacement Constraint
expression_4 = Expression(x=analyze.MaximumDisplacement_cm, Expression="x/100")  # -> flatten(R)
actual_displacement_m = Panel(expression_4)
bnd = Bounds(Numbers=actual_displacement_m)
dedomain = DeconstructDomain(Domain=bnd)  # -> Start, End
max_allowable_displacement = Panel("0.014")
expression_5 = Expression(x=dedomain.End, y=max_allowable_displacement, Expression="x-y")

# ----
# Stress Constraint
panel_2 = Panel(beamview.LegendTags)
item = ListItem(List=panel_2, Index=0, Wrap=True)  # -> Item, Item1
expression_6 = Expression(x=item.Item1, Expression="Abs(x*10)")
max_allowable_stress_mpa = Panel("8")
max_actual_stress_mpa = Panel(expression_6)
expression_7 = Expression(x=max_actual_stress_mpa, y=max_allowable_stress_mpa, Expression="x-y")

constrfa = ConstructFishAttribute(Constraint=[expression_5, expression_7])

len = Length(Curve=intcrv.Curve)  # -> flatten(Length)
# Calculate Volume
panel_3 = Panel(len)

item_2 = ListItem(List=panel_3, Index=0, Wrap=True)

expression_8 = Expression(x=number_slider_5, y=number_slider_4, z=item_2, u=number_slider, Expression="(x/100)*(y/100)*z*(u+1)")
volume_m_3 = Panel(expression_8)

# ----
# Calculate Weight
density_kg_m_3 = Panel("390")
expression_9 = Expression(x=density_kg_m_3, y=volume_m_3, Expression="x*y")
weight_kg = Panel(expression_9)

# ----
# Calculate Embodied Carbon
# Calculate Cost
embodied_carbon_per_kg_kgco2e_kg = Panel("0.493")
expression_10 = Expression(x=embodied_carbon_per_kg_kgco2e_kg, y=weight_kg, Expression="x*y")
total_embodied_carbon_kgco2 = Panel(expression_10)

lng = ListLength(List=pt_4)
explode_2 = Explode(Curve=srf, Recursive=True)  # -> Segments, Vertices
expression_11 = Expression(x=lng, Expression="x/2")
item_3 = ListItem(List=explode_2.Segments, Index=0, Wrap=True)  # -> Item, Item1, Item2, Item3
item_4 = ListItem(List=pt_4, Index=expression_11, Wrap=True)
explode_3 = Explode(Curve=intcrv.Curve, Recursive=True)  # -> Segments, Vertices
pt_6 = Point(item_4)
number_of_joints = Point(flatten(explode_3.Vertices))
pdecon_3 = Deconstruct(Point=pt_6)  # -> XComponent, YComponent, ZComponent
span = Curve(item_3.Item3)
len_2 = Length(Curve=span)
lng_2 = ListLength(List=number_of_joints)
height = Number(pdecon_3.ZComponent)
complexity_factor = Panel("2")
price_per_kg_kg = Panel("0.825")
expression_12 = Expression(x=complexity_factor, y=lng_2, z=height, u=len_2, v=weight_kg, w=price_per_kg_kg, Expression="x*y*z*u*v*w")
price = Panel(expression_12)

wlc_minimize_embodied_carbon = Number(total_embodied_carbon_kgco2)
wlc_minimize_cost = Number(price)
tunny = Tunny(
    Variables=[number_slider, number_slider_3, number_slider_5, number_slider_4],
    Objectives=[wlc_minimize_embodied_carbon, wlc_minimize_cost],
    Attributes=constrfa)
deconf = DeconstructFish(Fishes=tunny)  # -> Variables, Objectives, Attributes
panel_4 = Panel(tunny)
panel_5 = Panel(deconf.Objectives)
panel_6 = Panel(deconf.Variables)
