# Grasshopper definition Timber Non-Form Active.gh (Grasshopper 1.0.8)
# plug-ins: Tunny, Karamba3D

# ----
# Make Horizontal Lines
srf = Surface(<surface referenced from the Rhino model>)
explode = Explode(Curve=srf, Recursive=True)  # -> Segments, Vertices
item = ListItem(List=explode.Segments, Index=0, Wrap=True)  # -> Item, Item1, Item2, Item3
number_slider = Slider(1, range=1..20)
crv = Curve(item.Item2)
crv_2 = Curve(item.Item)
flip = FlipCurve(Curve=crv_2)  # -> Curve, Flag
divide = DivideCurve(Curve=crv, Count=number_slider, Kinks=False)  # -> Points, Tangents, Parameters
divide_2 = DivideCurve(Curve=flip.Curve, Count=number_slider, Kinks=False)  # -> Points, Tangents, Parameters
ln = Line(StartPoint=divide_2.Points, EndPoint=divide.Points)

loads = LoadsKaramba3D(Vector=Vector(0, 0, -1), LCase="0", mode="Gravity")

number_slider_2 = Slider(216, range=1..250)
number_slider_3 = Slider(95, range=1..250)
mplane = MeshPlane(Boundary=srf, WidthCount=number_slider, HeightCount=10)  # -> Mesh, Area
# Assemble Model
supp = SupportKaramba3D(PosInd=[divide_2.Points, divide.Points], menu=[buttons(on, on, on, on, on, on)])
cross_section = CrossSectionKaramba3D(
    FamilyNameOfCrossSection="DefaultCroSec",
    Height_cm=number_slider_3,
    UpperFlangeWidth_cm=number_slider_2,
    LowerFlangeWidth_cm=number_slider_2,
    mode="Trapezoid")
matselect = MaterialSelectionKaramba3D(menu=[dropdown(2), dropdown(1)])
linetobeam = LineToBeamKaramba3D(
    Line=ln,
    New=True,
    Remove=True,
    LimitDistance_m=0.005,
    Bending=True,
    SetBucklingLength=True,
    ToPolylineMaxAngle=0.03,
    ToPolylineTolerance=0.01,
    ToPolylineMaxEdgeLength=0.25)  # -> Element, Points, Info

expression = Expression(x="0.4", Expression="1.5*x")

Z = UnitZ(Factor=expression)  # -> expr("-x", UnitVector)
loads_2 = LoadsKaramba3D(Vector=Z, Mesh=mplane.Mesh, LCase="0", mode="MeshLoad -Const.", menu=[buttons(on, off, off), buttons(off, on)])
assemble = AssembleModelKaramba3D(
    Elem=linetobeam.Element,
    Support=supp,
    Load=[loads_2, loads],
    CrossSection=cross_section,
    Material=matselect,
    LimitDistance_m=0.005)  # -> Model, Info, Mass_kg, CenterOfGravity, LoadCaseNames

# ----
# Analysis and Results
analyze = AnalyzeKaramba3D(Model=assemble.Model)  # -> CalculatedModel, MaximumDisplacement_cm, ResultingForceOfGravity_kN, ElasticEnergyChange_kNm
modelview = ModelViewKaramba3D(Model=analyze.CalculatedModel, ResultFactors=1, ResultCase=-1)  # -> Model, DeformedMesh, DeformedAxes, DeformedModel
beamview = BeamViewKaramba3D(Model=modelview.Model)  # -> Model, MeshesOfRenderedBeams, DeformedBeamAxes, LegendColors, LegendTags
legend = Legend(Colour=beamview.LegendColors, Tags=beamview.LegendTags, LegendType=1)

# ----
# Calculate Volume
crv_3 = Curve(item.Item1)
len = Length(Curve=crv_3)
panel = Panel(len)
expression_2 = Expression(x=number_slider_3, y=number_slider_2, z=panel, u=number_slider, Expression="(x/100)*(y/100)*z*(u+1)")
volume_m_3 = Panel(expression_2)

# ----
# Calculate Weight
density_kg_m_3 = Panel("390")
expression_3 = Expression(x=density_kg_m_3, y=volume_m_3, Expression="x*y")
weight_kg = Panel(expression_3)

# ----
# Stress Constraint
panel_2 = Panel(beamview.LegendTags)
item_2 = ListItem(List=panel_2, Index=0, Wrap=True)  # -> Item, Item1
expression_4 = Expression(x=item_2.Item1, Expression="Abs(x*10)")
max_allowable_stress_mpa = Panel("8")
max_actual_stress_mpa = Panel(expression_4)
expression_5 = Expression(x=max_actual_stress_mpa, y=max_allowable_stress_mpa, Expression="x-y")

# ----
# Displacement Constraint
expression_6 = Expression(x=analyze.MaximumDisplacement_cm, Expression="x/100")
expression_7 = Expression(x="5", Expression="x/300")
actual_displacement_m = Panel(expression_6)
max_allowable_displacement = Panel(expression_7)
expression_8 = Expression(x=actual_displacement_m, y=max_allowable_displacement, Expression="x-y")

# ----
# Calculate Cost
merge = Merge(Data1=divide_2.Points, Data2=divide.Points)
expression_9 = Expression(x=number_slider_3, Expression="x/100")
number_of_joints = Point(flatten(merge))
span = Curve(item.Item3)
len_2 = Length(Curve=span)
lng = ListLength(List=number_of_joints)
height = Number(expression_9)
complexity_factor = Panel("1")
price_per_kg_kg = Panel("0.825")
expression_10 = Expression(x=complexity_factor, y=lng, z=height, u=len_2, v=weight_kg, w=price_per_kg_kg, Expression="x*y*z*u*v*w")
price = Panel(expression_10)

# ----
# Calculate Embodied Carbon
embodied_carbon_per_kg_kgco2e_kg = Panel("0.493")
expression_11 = Expression(x=embodied_carbon_per_kg_kgco2e_kg, y=weight_kg, Expression="x*y")
total_embodied_carbon_kgco2 = Panel(expression_11)

constrfa = ConstructFishAttribute(Constraint=[expression_8, expression_5])
wlc_minimize_cost = Number(price)
wlc_minimize_embodied_carbon = Number(total_embodied_carbon_kgco2)
tunny = Tunny(
    Variables=[number_slider, number_slider_3, number_slider_2],
    Objectives=[wlc_minimize_embodied_carbon, wlc_minimize_cost],
    Attributes=constrfa)
deconf = DeconstructFish(Fishes=tunny)  # -> Variables, Objectives, flatten(Attributes)
panel_3 = Panel(tunny)
panel_4 = Panel(deconf.Attributes)
panel_5 = Panel(deconf.Objectives)
panel_6 = Panel(deconf.Variables)
