# Grasshopper definition Timber Semi-Form Active Improved.gh (Grasshopper 1.0.8)
# plug-ins: Tunny, Karamba3D, LunchBox

srf = Surface(<surface referenced from the Rhino model>)
Z = UnitZ(Factor=Slider(0.5, range=0.5..3))
move = Move(Geometry=srf, Motion=Z)  # -> Geometry, Transform
explode = Explode(Curve=move.Geometry, Recursive=True)  # -> Segments, Vertices
explode_2 = Explode(Curve=srf, Recursive=True)  # -> Segments, Vertices
item = ListItem(List=explode_2.Segments, Index=0, Wrap=True)  # -> Item, Item1, Item2
item_2 = ListItem(List=explode.Segments, Index=0, Wrap=True)  # -> Item, Item1, Item2
number_slider = Slider(5, range=1..30)
flip = FlipCurve(Curve=item_2.Item2)  # -> Curve, Flag
flip_2 = FlipCurve(Curve=item.Item)  # -> Curve, Flag
divide = DivideCurve(Curve=flip_2.Curve, Count=number_slider, Kinks=False)  # -> Points, Tangents, Parameters
divide_2 = DivideCurve(Curve=item.Item2, Count=number_slider, Kinks=False)  # -> Points, Tangents, Parameters
divide_3 = DivideCurve(Curve=item_2.Item, Count=number_slider, Kinks=False)  # -> Points, Tangents, Parameters
divide_4 = DivideCurve(Curve=flip.Curve, Count=number_slider, Kinks=False)  # -> Points, Tangents, Parameters
ln = Line(StartPoint=divide.Points, EndPoint=divide_2.Points)
ln_2 = Line(StartPoint=divide_3.Points, EndPoint=divide_4.Points)

divide_5 = DivideCurve(Curve=ln, Count=Slider(4, range=0..10), Kinks=False)  # -> Points, Tangents, Parameters
item_3 = ListItem(List=divide_5.Points, Index=0, Wrap=True)  # -> Item, Item1, Item2, Item3, Item4
number_slider_2 = Slider(0.5, range=0.1..3)
number_slider_3 = Slider(0.5, range=0.1..3)
number_slider_4 = Slider(1.8, range=0.1..3)
Z_2 = UnitZ(Factor=number_slider_3)
Z_3 = UnitZ(Factor=number_slider_2)
Z_4 = UnitZ(Factor=number_slider_4)
pt = Point(item_3.Item)
pt_2 = Point(item_3.Item4)
move_2 = Move(Geometry=item_3.Item3, Motion=Z_2)  # -> Geometry, Transform
move_3 = Move(Geometry=item_3.Item2, Motion=Z_4)  # -> Geometry, Transform
move_4 = Move(Geometry=item_3.Item1, Motion=Z_3)  # -> Geometry, Transform
merge = Merge(Data1=pt, Data2=move_4.Geometry, Data3=move_3.Geometry, Data4=move_2.Geometry, Data5=pt_2)
pline = PolyLine(Vertices=merge, Closed=False)  # -> flatten(Polyline)

divide_6 = DivideCurve(Curve=ln_2, Count=Slider(4, range=0..10), Kinks=False)  # -> Points, Tangents, Parameters
item_4 = ListItem(List=divide_6.Points, Index=0, Wrap=True)  # -> Item, Item1, Item2, Item3, Item4
number_slider_5 = Slider(0.8, range=0..3)
number_slider_6 = Slider(0.7, range=0..3)
number_slider_7 = Slider(0.7, range=0..3)
number_slider_8 = Slider(0.3, range=0..3)
number_slider_9 = Slider(0.3, range=0..3)
expression = Expression(x=number_slider_7, y=number_slider_2, Expression="x+y")
expression_2 = Expression(x=number_slider_6, y=number_slider_3, Expression="x+y")
expression_3 = Expression(x=number_slider_5, y=number_slider_4, Expression="x+y")
Z_5 = UnitZ(Factor=expression)
Z_6 = UnitZ(Factor=number_slider_9)
Z_7 = UnitZ(Factor=expression_3)
Z_8 = UnitZ(Factor=expression_2)
Z_9 = UnitZ(Factor=number_slider_8)
move_5 = Move(Geometry=item_4.Item1, Motion=Z_5)  # -> Geometry, Transform
move_6 = Move(Geometry=item_4.Item3, Motion=Z_8)  # -> Geometry, Transform
move_7 = Move(Geometry=item_4.Item2, Motion=Z_7)  # -> Geometry, Transform
move_8 = Move(Geometry=item_4.Item4, Motion=Z_6)  # -> Geometry, Transform
move_9 = Move(Geometry=item_4.Item, Motion=Z_9)  # -> Geometry, Transform
merge_2 = Merge(Data1=move_9.Geometry, Data2=move_5.Geometry, Data3=move_7.Geometry, Data4=move_6.Geometry, Data5=move_8.Geometry)
pline_2 = PolyLine(Vertices=merge_2, Closed=False)  # -> flatten(Polyline)

number_slider_10 = Slider(5, range=2..15)
truss = _2DTruss(CurveA=reverse(pline), CurveB=pline_2, Divisions=number_slider_10, TrussToggle=Slider(0, range=0..2))  # -> PrimaryLines, BraceLines, VerticalLines, StructureNodes

Z_10 = UnitZ(Factor=1)

crv = Curve([truss.BraceLines, truss.VerticalLines, truss.PrimaryLines])
mplane = MeshPlane(Boundary=srf, WidthCount=number_slider, HeightCount=10)  # -> Mesh, Area
linetobeam = LineToBeamKaramba3D(
    Line=crv,
    New=True,
    Remove=True,
    LimitDistance_m=0.005,
    Bending=Toggle(False),
    SetBucklingLength=True,
    ToPolylineMaxAngle=0.03,
    ToPolylineTolerance=0.01,
    ToPolylineMaxEdgeLength=0.25)  # -> Element, Points, Info
pt_3 = Point(truss.StructureNodes)
number_slider_11 = Slider(11, range=2..50)
lng = ListLength(List=pt_3)
number_slider_12 = Slider(10, range=2..50)
expression_4 = Expression(x=lng, Expression="x-2")
item_5 = ListItem(List=pt_3, Index=expression_4, Wrap=True)
item_6 = ListItem(List=pt_3, Index=0, Wrap=True)
cross_section = CrossSectionKaramba3D(
    FamilyNameOfCrossSection="DefaultCroSec",
    Height_cm=number_slider_12,
    UpperFlangeWidth_cm=number_slider_11,
    LowerFlangeWidth_cm=number_slider_11,
    mode="Trapezoid")
supp = SupportKaramba3D(PosInd=[item_5, item_6], menu=[buttons(on, on, on, on, on, on)])
matselect = MaterialSelectionKaramba3D(menu=[dropdown(2), dropdown(1)])
loads = LoadsKaramba3D(Vector=Vector(0, 0, -1), LCase="0", mode="Gravity")

move_10 = Move(Geometry=mplane.Mesh, Motion=Z_10)  # -> Geometry, Transform
expression_5 = Expression(x="-0.4", Expression="1.5*x")

Z_11 = UnitZ(Factor=expression_5)
loads_2 = LoadsKaramba3D(Vector=Z_11, Mesh=move_10.Geometry, LCase="0", mode="MeshLoad -Const.", menu=[buttons(on, off, off), buttons(on, off)])
assemble = AssembleModelKaramba3D(
    Point=truss.StructureNodes,
    Elem=linetobeam.Element,
    Support=supp,
    Load=[loads, loads_2],
    CrossSection=cross_section,
    Material=matselect,
    LimitDistance_m=0.005)  # -> flatten(Model), Info, Mass_kg, CenterOfGravity, LoadCaseNames

# ----
# Calculate Volume
num = Number(number_slider_11)
num_2 = Number(number_slider)
num_3 = Number(number_slider_12)
horizontal_lines = Curve(truss.PrimaryLines)
diagonal_lines = Curve(truss.BraceLines)
vertical_lines = Curve(truss.VerticalLines)
lng_2 = ListLength(List=diagonal_lines)
len = Length(Curve=diagonal_lines)
lng_3 = ListLength(List=vertical_lines)
lng_4 = ListLength(List=horizontal_lines)
len_2 = Length(Curve=horizontal_lines)
len_3 = Length(Curve=vertical_lines)
expression_6 = Expression(x=num, y=num_3, z=len, u=lng_2, v=num_2, Expression="((x/100)*(y/100)*z)*(u*(v+1))")  # -> flatten(R)
expression_7 = Expression(x=num, y=num_3, z=len_3, u=lng_3, v=num_2, Expression="((x/100)*(y/100)*z)*(u*(v+1))")  # -> flatten(R)
expression_8 = Expression(x=num, y=num_3, z=len_2, u=lng_4, v=num_2, Expression="((x/100)*(y/100)*z)*(u*(v+1))")  # -> flatten(R)
item_7 = ListItem(List=expression_8, Index=0, Wrap=True)
item_8 = ListItem(List=expression_7, Index=0, Wrap=True)
item_9 = ListItem(List=expression_6, Index=0, Wrap=True)
expression_9 = Expression(x=item_7, y=item_9, z=item_8, Expression="x+y+z")
volume_m_3 = Panel(expression_9)

analyze = AnalyzeKaramba3D(Model=assemble.Model)  # -> flatten(CalculatedModel), flatten(MaximumDisplacement_cm), ResultingForceOfGravity_kN, ElasticEnergyChange_kNm
modelview = ModelViewKaramba3D(Model=flatten(analyze.CalculatedModel), ResultFactors=1, ResultCase=-1)  # -> flatten(Model), DeformedMesh, DeformedAxes, DeformedModel
beamview = BeamViewKaramba3D(Model=modelview.Model)  # -> Model, MeshesOfRenderedBeams, DeformedBeamAxes, flatten(LegendColors), flatten(LegendTags)
panel = Panel(analyze.MaximumDisplacement_cm)
panel_2 = Panel(beamview.LegendTags)

# ----
# Stress
item_10 = ListItem(List=panel_2, Index=0, Wrap=True)  # -> Item, Item1
expression_10 = Expression(x=item_10.Item1, Expression="Abs(x*10)")
max_allowable_stress = Panel("8")
actual_stress_n_mm_2 = Panel(expression_10)

# ----
# Displacement
lng_5 = ListLength(List=panel)
expression_11 = Expression(x=lng_5, Expression="x/2")
item_11 = ListItem(List=panel, Index=expression_11, Wrap=True)
expression_12 = Expression(x=item_11, Expression="x/100")
max_allowable_displacement_m = Panel("0.014")
actual_displacement_m = Panel(expression_12)

# ----
# Calculate Weight
density_kg_m_3 = Panel("390")
expression_13 = Expression(x=density_kg_m_3, y=volume_m_3, Expression="x*y")
weight_kg = Panel(expression_13)

expression_14 = Expression(x=actual_stress_n_mm_2, y=max_allowable_stress, Expression="x-y")
expression_15 = Expression(x=actual_displacement_m, y=max_allowable_displacement_m, Expression="x-y")

# ----
# Calculate Cost
merge_3 = Merge(
    Data1=number_slider_2,
    Data2=number_slider_4,
    Data3=number_slider_3,
    Data4=number_slider_8,
    Data5=number_slider_7,
    Data6=number_slider_5,
    Data7=number_slider_6,
    Data8=number_slider_9)
bnd = Bounds(Numbers=merge_3)
number_of_joints = Point(flatten(truss.StructureNodes))
span = Curve(item.Item1)
dedomain = DeconstructDomain(Domain=bnd)  # -> Start, End
len_4 = Length(Curve=span)
lng_6 = ListLength(List=number_of_joints)
height = Number(dedomain.End)
complexity_factor = Panel("1.75")
price_per_kg_kg = Panel("0.825")
expression_16 = Expression(x=complexity_factor, y=lng_6, z=height, u=len_4, v=weight_kg, w=price_per_kg_kg, Expression="x*y*z*u*v*w")
price = Panel(expression_16)

# ----
# Calculate Embodied Carbon
embodied_carbon_kgco2e_kg = Panel("0.493")
expression_17 = Expression(x=embodied_carbon_kgco2e_kg, y=weight_kg, Expression="x*y")
total_embodied_carbon_kgco2e = Panel(expression_17)

constrfa = ConstructFishAttribute(Constraint=[expression_15, expression_14])
minimize_embodied_carbon = Number(total_embodied_carbon_kgco2e)
minimize_cost = Number(price)
tunny = Tunny(
    Variables=[number_slider, number_slider_12, number_slider_11, number_slider_10, number_slider_8, number_slider_7, number_slider_5, number_slider_6, number_slider_9, number_slider_2, number_slider_4, number_slider_3],
    Objectives=[minimize_cost, minimize_embodied_carbon],
    Attributes=constrfa)
deconf = DeconstructFish(Fishes=tunny)  # -> Variables, Objectives, Attributes, Attributes_2
panel_3 = Panel(deconf.Objectives)
panel_4 = Panel(deconf.Attributes)
