# Grasshopper definition Timber Semi-Form Active.gh (Grasshopper 1.0.8)
# plug-ins: Tunny, Karamba3D

# ----
# Horizontal Lines
srf = Surface(<surface referenced from the Rhino model>)
explode = Explode(Curve=srf, Recursive=True)  # -> Segments, Vertices
item = ListItem(List=explode.Segments, Index=0, Wrap=True)  # -> Item, Item1, Item2, Item3
number_slider = Slider(2, range=2..20)
crv = Curve(item.Item2)
crv_2 = Curve(item.Item)
flip = FlipCurve(Curve=crv_2)  # -> Curve, Flag
divide = DivideCurve(Curve=crv, Count=number_slider, Kinks=False)  # -> Points, Tangents, Parameters
divide_2 = DivideCurve(Curve=flip.Curve, Count=number_slider, Kinks=False)  # -> Points, Tangents, Parameters
ln = Line(StartPoint=divide_2.Points, EndPoint=divide.Points)

# ----
# Making Curve from Line
number_slider_2 = Slider(4, range=0..10)
divide_3 = DivideCurve(Curve=ln, Count=number_slider_2, Kinks=False)  # -> Points, Tangents, Parameters
item_2 = ListItem(List=divide_3.Points, Index=0, Wrap=True)  # -> Item, Item1, Item2, Item3, Item4
number_slider_3 = Slider(1, range=0.1..3)
number_slider_4 = Slider(0.9, range=0.1..3)
number_slider_5 = Slider(0.9, range=0.1..3)
pt = Point(item_2.Item4)
pt_2 = Point(item_2.Item)
Z = UnitZ(Factor=number_slider_4)
Z_2 = UnitZ(Factor=number_slider_3)
Z_3 = UnitZ(Factor=number_slider_5)
move = Move(Geometry=item_2.Item1, Motion=Z)  # -> Geometry, Transform
move_2 = Move(Geometry=item_2.Item2, Motion=Z_2)  # -> Geometry, Transform
move_3 = Move(Geometry=item_2.Item3, Motion=Z_3)  # -> Geometry, Transform
merge = Merge(Data1=pt_2, Data2=move.Geometry, Data3=move_2.Geometry, Data4=move_3.Geometry, Data5=pt)

pline = PolyLine(Vertices=merge, Closed=False)  # -> flatten(Polyline)

lng = ListLength(List=pline)
expression = Expression(x=lng, Expression="x-2")
dom = ConstructDomain(DomainStart=Slider(1, range=0..1), DomainEnd=expression)
range = Range(Domain=dom, Steps=expression)
item_3 = ListItem(List=pline, Index=range, Wrap=True)  # -> Item, Item1
crv_3 = Curve(flatten(item_3.Item))

lng_2 = ListLength(List=pline)
expression_2 = Expression(x=lng_2, Expression="x-1")
item_4 = ListItem(List=pline, Index=0, Wrap=True)  # -> Item, Item1
item_5 = ListItem(List=pline, Index=expression_2, Wrap=True)
crv_4 = Curve(item_4.Item)
crv_5 = Curve(item_5)
merge_2 = Merge(Data1=crv_4, Data2=crv_5)  # -> flatten(Result)

linetobeam = LineToBeamKaramba3D(
    Line=crv_3,
    New=True,
    Remove=True,
    LimitDistance_m=0.005,
    Bending=True,
    SetBucklingLength=True,
    ToPolylineMaxAngle=0.03,
    ToPolylineTolerance=0.01,
    ToPolylineMaxEdgeLength=0.25)  # -> Element, Points, Info
# Assemble Model
linetobeam_2 = LineToBeamKaramba3D(
    Line=merge_2,
    New=True,
    Remove=True,
    LimitDistance_m=0.005,
    Bending=True,
    SetBucklingLength=True,
    ToPolylineMaxAngle=0.03,
    ToPolylineTolerance=0.01,
    ToPolylineMaxEdgeLength=0.25)  # -> Element, Points, Info
number_slider_6 = Slider(5, range=5..100)
depth_m = Panel("30")
expression_3 = Expression(x=depth_m, y=number_slider, z=number_slider_6, Expression="((x/y)/2)*z")
imposed_load_kn_m_2 = Panel("0.4")
expression_4 = Expression(x=depth_m, y=number_slider, z=number_slider_6, Expression="(x/y)*z")
loaded_area_for_outer_beams_m_2 = Panel(expression_3)
loaded_area_for_inner_beams_m_2 = Panel(expression_4)
number_slider_7 = Slider(12, range=5..100)
number_slider_8 = Slider(40, range=5..100)
cross_section = CrossSectionKaramba3D(
    FamilyNameOfCrossSection="DefaultCroSec",
    Height_cm=number_slider_8,
    UpperFlangeWidth_cm=number_slider_7,
    LowerFlangeWidth_cm=number_slider_7,
    mode="Trapezoid")
supp = SupportKaramba3D(PosInd=[divide_2.Points, divide.Points], menu=[buttons(on, on, on, on, on, on)])  # -> flatten(Support)
matselect = MaterialSelectionKaramba3D(menu=[dropdown(2), dropdown(1)])
loads = LoadsKaramba3D(Vector=Vector(0, 0, -1), LCase="0", mode="Gravity")

expression_5 = Expression(x=imposed_load_kn_m_2, Expression="1.5*x")

expression_6 = Expression(x=expression_5, y=loaded_area_for_outer_beams_m_2, Expression="x*y")
expression_7 = Expression(x=expression_5, y=loaded_area_for_inner_beams_m_2, Expression="x*y")
load_inner_beams_kn = Panel(expression_7)
load_outer_beam_kn = Panel(expression_6)
Z_4 = UnitZ(Factor=load_outer_beam_kn)  # -> expr("-x", UnitVector)
Z_5 = UnitZ(Factor=load_inner_beams_kn)  # -> expr("-x", UnitVector)
beam_loads = BeamLoadsKaramba3D(
    BeamIdentifier=linetobeam_2.Element,
    LoadCase="0",
    ForceVector=Z_4,
    TStart=0,
    TEnd=1,
    mode="Block",
    menu=[buttons(off, on, off)])  # -> flatten(Load)
beam_loads_2 = BeamLoadsKaramba3D(
    BeamIdentifier=linetobeam.Element,
    LoadCase="0",
    ForceVector=Z_5,
    TStart=0,
    TEnd=1,
    mode="Block",
    menu=[buttons(off, on, off)])  # -> flatten(Load)

assemble = AssembleModelKaramba3D(
    Elem=[linetobeam.Element, linetobeam_2.Element],
    Support=supp,
    Load=[beam_loads, loads, beam_loads_2],
    CrossSection=cross_section,
    Material=matselect,
    LimitDistance_m=0.005)  # -> Model, Info, Mass_kg, CenterOfGravity, LoadCaseNames

# ----
# Calculate Volume
crv_6 = Curve(crv_4)
len = Length(Curve=crv_6)
panel = Panel(len)
expression_8 = Expression(x=number_slider_8, y=number_slider_7, z=panel, u=number_slider, Expression="(x/100)*(y/100)*z*(u+1)")
volume_m_3 = Panel(expression_8)

# ----
# Analysis and Results
analyze = AnalyzeKaramba3D(Model=assemble.Model)  # -> CalculatedModel, MaximumDisplacement_cm, ResultingForceOfGravity_kN, ElasticEnergyChange_kNm
modelview = ModelViewKaramba3D(Model=analyze.CalculatedModel, ResultFactors=1, ResultCase=-1)  # -> Model, DeformedMesh, DeformedAxes, DeformedModel
beamview = BeamViewKaramba3D(Model=modelview.Model)  # -> Model, MeshesOfRenderedBeams, DeformedBeamAxes, LegendColors, LegendTags
legend = Legend(Colour=beamview.LegendColors, Tags=beamview.LegendTags, LegendType=1)

# ----
# Calculate Weight
density_kg_m_3 = Panel("390")
expression_9 = Expression(x=density_kg_m_3, y=volume_m_3, Expression="x*y")
weight_kg = Panel(expression_9)

# ----
# Calculate Cost
merge_3 = Merge(Data1=number_slider_4, Data2=number_slider_3, Data3=number_slider_5)
bnd = Bounds(Numbers=merge_3)
number_of_joints = Point(flatten(divide_3.Points))
span = Curve(item.Item3)
dedomain = DeconstructDomain(Domain=bnd)  # -> Start, End
len_2 = Length(Curve=span)
lng_3 = ListLength(List=number_of_joints)
height = Number(dedomain.End)
complexity_factor = Panel("1.5")
price_per_kg_kg = Panel("0.825")
expression_10 = Expression(x=complexity_factor, y=lng_3, z=height, u=len_2, v=weight_kg, w=price_per_kg_kg, Expression="x*y*z*u*v*w")
price = Panel(expression_10)

# ----
# Calculate Embodied Carbon
embodied_carbon_per_kg_kgco2e_kg = Panel("0.493")
expression_11 = Expression(x=embodied_carbon_per_kg_kgco2e_kg, y=weight_kg, Expression="x*y")
total_embodied_carbon_kgco2 = Panel(expression_11)

panel_2 = Panel(beamview.LegendTags)
# Constraints
expression_12 = Expression(x=analyze.MaximumDisplacement_cm, Expression="x/100")
item_6 = ListItem(List=panel_2, Index=0, Wrap=True)  # -> Item, Item1
actual_displacement_m = Panel(expression_12)
max_allowable_displacement = Panel("0.014")
expression_13 = Expression(x=item_6.Item1, Expression="Abs(x*10)")
max_allowable_stress_mpa = Panel("8")
max_actual_stress_mpa = Panel(expression_13)
expression_14 = Expression(x=actual_displacement_m, y=max_allowable_displacement, Expression="x-y")
expression_15 = Expression(x=max_actual_stress_mpa, y=max_allowable_stress_mpa, Expression="x-y")
constrfa = ConstructFishAttribute(Constraint=[expression_14, expression_15])

wlc_minimize_embodied_carbon = Number(total_embodied_carbon_kgco2)
wlc_minimize_cost = Number(price)
tunny = Tunny(
    Variables=[number_slider, number_slider_8, number_slider_7, number_slider_4, number_slider_3, number_slider_5],
    Objectives=[wlc_minimize_embodied_carbon, wlc_minimize_cost],
    Attributes=constrfa)
deconf = DeconstructFish(Fishes=tunny)  # -> Variables, Objectives, Attributes
panel_3 = Panel(tunny)
panel_4 = Panel(deconf.Attributes)
panel_5 = Panel(deconf.Objectives)
panel_6 = Panel(deconf.Variables)
